# Dynamo graph 3BoxVolumeSurfaceArea-SimpleBiLT.dyn "3BoxVolumeSurfaceAreaOTx-Simple" (Dynamo 2.0.2.6826)

# group: Inputs
height_box_1 = DoubleSlider(115.7076328, range=19.70763281..200 step 1)  # graph input
locationx_box2 = DoubleSlider(22, range=0..50 step 1)  # graph input
locationy_box2 = DoubleSlider(38, range=0..50 step 1)  # graph input
height_box_2 = DoubleSlider(44, range=20..200 step 1)  # graph input
locationx_box3 = DoubleSlider(43.10650294, range=20.10650294..70 step 1)  # graph input
locationy_box3 = DoubleSlider(20.48223563, range=20.48223563..70 step 1)  # graph input
height_box_3 = DoubleSlider(78, range=20..200 step 1)  # graph input

# group: Create geometry
code_block = CodeBlock(h=height_box_1) { h/2; }
byCoordinates = Point.ByCoordinates(z=code_block)
width = CodeBlock { 50; }
byLengths = Cuboid.ByLengths(origin=byCoordinates, width=width, length=width, height=height_box_1)
code_block_2 = CodeBlock(h=height_box_2) { h/2; }
byCoordinates_2 = Point.ByCoordinates(x=locationx_box2, y=locationy_box2, z=code_block_2)
byLengths_2 = Cuboid.ByLengths(origin=byCoordinates_2, width=width, length=width, height=height_box_2)
code_block_3 = CodeBlock(h=height_box_3) { h/2; }
byCoordinates_3 = Point.ByCoordinates(x=locationx_box3, y=locationy_box3, z=code_block_3)
byLengths_3 = Cuboid.ByLengths(origin=byCoordinates_3, width=width, length=width, height=height_box_3)
list_create = List.Create(item0=byLengths, item1=byLengths_2, item2=byLengths_3)
byUnion = Solid.ByUnion(solids=list_create)

# group: Analysis: Surface Area and Volume
area = Solid.Area(solid=byUnion)
volume = Solid.Volume(solid=byUnion)

# group: Outputs
surface_area = Watch(area)  # graph output
volume_2 = Watch(volume)  # graph output

# group: Display
color_palette = ColorPalette({R: 0, G: 191, B: 255, A: 255})
byGeometryColor = Modifiers.GeometryColor.ByGeometryColor(geometry=byUnion, color=color_palette)
