# Dynamo graph 04_2d Hill Climbing 5 point diff hill.dyn "2d Hill Climbing 5 point diff hill" (Dynamo 2.0.3.8810)

# note: Working / Functions
# Orange indicates the working of the script. No changes should be made in these groups unless advised.
# note: Variables / Inputs
# Green indicates Variables that can be altered per project and must be set accordingly before running the script.

# group: BiLT NA 2019 How To Train Your Model 2d Hill Climbing - 5 Points
# note: REQUIRED DYNAMO PACKAGES
# None
# note: ADDITIONAL COMMENTS
# note: DYNAMO VERSION
# 2.0.2
# note: DYNAMO PROJECT
# How to Train Your Model BiLT 2019
# note: ASSOCIATED FILE(S)
# N/A
# note: AUTHOR(S) / CREATION DATE
# Matt Jezyk / June 2019
# note: DESCRIPTION
# The 2d Hill Climbing dyn will create a spline to represent a 2d landscape. Points will then be created via a Generator and the maximum height computed in the Evaluator. This graph can be used in Refinery via Randomize or Optimize to find the highest point. Note the second Evaluator for the 'Max Y Delta' - simply the sum of how far all the points move away from the origin. This can be used as a competing goal if you modify the spline landcape to make the hill to the right higher.

# group: Model Setup - Hill Creation
start_point = Point.ByCoordinates()
code_block = CodeBlock { 25; 50; 75; 100; }
number_slider = DoubleSlider(0, range=0..100 step 0.1)
end_point = Point.ByCoordinates(y=code_block.out3, z=number_slider)
list_create = List.Create(item0=start_point, item1=end_point)
flat_line = NurbsCurve.ByPoints(points=list_create)
# note: Checking / Outputs
# Red indicates checking nodes to ensure the script has deployed correctly.
number_slider_2 = DoubleSlider(72.5, range=0..100 step 0.1)
point_1 = Point.ByCoordinates(y=code_block.out0, z=number_slider_2)
number_slider_3 = DoubleSlider(24, range=0..100 step 0.1)
point_2 = Point.ByCoordinates(y=code_block.out1, z=number_slider_3)
number_slider_4 = DoubleSlider(39.9, range=0..100 step 0.1)
point_3 = Point.ByCoordinates(y=code_block.out2, z=number_slider_4)
list_create_2 = List.Create(item0=start_point, item1=point_1, item2=point_2, item3=point_3, item4=end_point)
hill_curve = NurbsCurve.ByPoints(points=list_create_2)

# group: Input - Vary Point Delta Y
pt0_delta_y = DoubleSlider(26, range=0..100 step 0.1)  # graph input
pt1_delta_y = DoubleSlider(24.6, range=0..100 step 0.1)  # graph input
pt2_delta_y = DoubleSlider(22.2, range=0..100 step 0.1)  # graph input
pt3_delta_y = DoubleSlider(22.3, range=0..100 step 0.1)  # graph input
pt4_delta_y = DoubleSlider(21.6, range=0..100 step 0.1)  # graph input

# group: Generator - Create Points
list_create_3 = List.Create(item0=pt0_delta_y, item1=pt1_delta_y, item2=pt2_delta_y, item3=pt3_delta_y, item4=pt4_delta_y)
byCoordinates = Point.ByCoordinates(y=list_create_3)

# group: Evaluator - Find Maximum Height
ZAxis = Vector.ZAxis()
project = Point.Project(point=byCoordinates, baseGeometry=hill_curve, projectionDirection=ZAxis)
code_block_2 = CodeBlock { 3; }
XAxis = Vector.XAxis()
byCenterPointRadiusNormal = Circle.ByCenterPointRadiusNormal(centerPoint=project, radius=code_block_2, normal=XAxis)
Z = Point.Z(point=project)
flatten = List.Flatten(list=Z)
sum_total_height = Math.Sum(values=flatten)

# group: Evaluator - Max Delta Y
sum_total_length = Math.Sum(values=list_create_3)

# group: Output
sumZHeights = Watch(sum_total_height)  # graph output
sumYDelta = Watch(sum_total_length)  # graph output
