# Dynamo graph 06_pointPlotterPython-Newtown-START.dyn "pointPlotterPythonJustCurves4" (Dynamo 2.0.3.8810)

# group: Function Plotter
guess = DoubleSlider(0, range=0..100 step 0.1)
yRangeLimit = IntegerSlider(300, range=0..300 step 1)
numSteps = IntegerSlider(41, range=0..100 step 1)
offset = DoubleSlider(0, range=0..100 step 0.1)
offset_2 = DoubleSlider(0, range=0..100 step 0.1)
functionPlotter = Python(IN[0]=guess, IN[1]=yRangeLimit, IN[2]=numSteps, IN[3]=offset, IN[4]=offset_2)
# ---------- functionPlotter.python (55 lines) ----------
# Enable Python support and load DesignScript library
import clr
clr.AddReference('ProtoGeometry')
from Autodesk.DesignScript.Geometry import *

# The inputs to this node will be stored as a list in the IN variables.
dataEnteringNode = IN

xGuess = IN[0]
yRangeLimit = IN[1]
numSteps = IN[2]
offset = IN[3]
xOffset = IN[4]

# Place your code below this line

#Newton's Method in Python
#http://code.activestate.com/recipes/578419-newtons-method-to-solve-equations-in-python/

def f(x):
	return -(xOffset+x)**2 + offset #(x**3 + x)/100 + offset
	
def f_prime(x):
	return -xOffset - x #3*x**2 + 1
	
#f’(x) = (f(x + h/2) - f(x - h/2))/h



def newt(x,n):
	for i in range(n):
		if f_prime(x) == 0:
			return x
		x = x - f(x)/f_prime(x)
	return x
	

xPositions = []
yPositions = []


for i in range(-yRangeLimit,yRangeLimit,1):
    x = i/float(100.0) # scale range down to avoid limits and infinity
    y = f(x)
    xPositions.append(x)
    yPositions.append(y)
    #print('i: {0} x: {1} y: {2}'.format(i, x, y))

#print('The root is: ')
result = newt(float(xGuess),int(numSteps)) # guess, num steps
#print(result)


# Assign your output to the OUT variable.
OUT = [xPositions, yPositions, result]
# ----------------------------------------
code_block = CodeBlock(calcPoints=functionPlotter)
# ---------- code_block.designscript (5 lines) ----------
calcPoints;
xPositions = calcPoints[0];
yPositions = calcPoints[1];
Point.ByCoordinates(xPositions,yPositions);
root = calcPoints[2];
# ----------------------------------------
watch = Watch(code_block.root)
byPoints = NurbsCurve.ByPoints(points=code_block.out3)

code_block_2 = CodeBlock(myCurve=byPoints) { myCurve; }

# group: Tangent Calc Via Nodes
t_param = DoubleSlider(0.501, range=0..1 step 0.01)  # graph input
code_block_3 = CodeBlock(x=t_param) { x; 0..1..x; 0; }
tangentAtParameter = Curve.TangentAtParameter(curve=code_block_2, param=code_block_3.x)
XAxis = Vector.XAxis()
angleWithVector = Vector.AngleWithVector(vector=tangentAtParameter, otherVector=XAxis)
angle_from_horizontal = Watch(angleWithVector)  # graph output
pointAtParameter = Curve.PointAtParameter(curve=code_block_2, param=code_block_3.x)
pointAtParameter_2 = Curve.PointAtParameter(curve=code_block_2, param=code_block_3.x)
code_block_4 = CodeBlock { 3; }
byStartPointDirectionLength = Line.ByStartPointDirectionLength(startPoint=pointAtParameter_2, direction=tangentAtParameter, length=code_block_4)

# group: Newton's Method - Find Root
xGuess = DoubleSlider(0, range=0..1 step 0.01)
numSteps_2 = IntegerSlider(500, range=0..500 step 1)
findMinSlope = Python(IN[0]=xGuess, IN[1]=numSteps_2, IN[2]=code_block_2)
# ---------- findMinSlope.python (55 lines) ----------
# Enable Python support and load DesignScript library
import clr
clr.AddReference('ProtoGeometry')
from Autodesk.DesignScript.Geometry import *

# The inputs to this node will be stored as a list in the IN variables.
dataEnteringNode = IN

tGuess = IN[0]
numSteps = IN[1]
hillCurve = IN[2]

tValues = []
yResults = []
tanVectors = []
slopeAngles = []

# Place your code below this line

#Newton's Method in Python
#http://code.activestate.com/recipes/578419-newtons-method-to-solve-equations-in-python/

def f(x): # for x (t param of curve), return y height for the curve

	evalPoint = hillCurve.PointAtParameter(x)
	y = evalPoint.Y
	yResults.append(y)
	return y
	
def f_prime(x): # for x (t param of curve), calc tangent and return slope of tangent line
	tanVector = hillCurve.TangentAtParameter(x)
	tanVectors.append(tanVector)
	slopeAngle = Vector.AngleWithVector(tanVector, Vector.XAxis())
	slopeAngles.append(slopeAngle)
	return slopeAngle
	
#f’(x) = (f(x + h/2) - f(x - h/2))/h



def newt(x,n): # find the value of t taht minimizes the slope
	for i in range(n):
		if f_prime(x) == 0:
			return x
		x = x - f(x)/f_prime(x)
		tValues.append(x)
	return x

#print('The root is: ')
result = newt(float(tGuess),int(numSteps)) # guess, num steps
#print(result)


# Assign your output to the OUT variable.
OUT = [result, tValues, tanVectors, slopeAngles]
# ----------------------------------------
watch_2 = Watch(findMinSlope)
firstItem = List.FirstItem(list=findMinSlope)
pointAtParameter_3 = Curve.PointAtParameter(curve=code_block_2, param=firstItem)
code_block_5 = CodeBlock(newtonResults=findMinSlope) { newtonResults; tValues = newtonResults[1]; tanVectors = newtonResults[2]; }
pointAtParameter_4 = Curve.PointAtParameter(curve=code_block_2, param=code_block_5.tValues)
code_block_6 = CodeBlock { 2; }
byStartPointDirectionLength_2 = Line.ByStartPointDirectionLength(startPoint=pointAtParameter_4, direction=code_block_5.tanVectors, length=code_block_6)

# group: Ellipse
XY = Plane.XY()
code_block_7 = CodeBlock { 3; 0; 180; }
byPlaneRadiiAngles = EllipseArc.ByPlaneRadiiAngles(plane=XY, xRadius=code_block_7.out0, yRadius=code_block_7.out0, startAngle=code_block_7.out1, sweepAngle=code_block_7.out2)
YAxis = Vector.YAxis()
reverse = Vector.Reverse(vector=YAxis)
translate = Geometry.Translate(geometry=byPlaneRadiiAngles, direction=reverse, distance=code_block_7.out0)

# group: Tangents as Colored Lines
color_palette = ColorPalette({R: 255, G: 69, B: 0, A: 255})
byGeometryColor = Modifiers.GeometryColor.ByGeometryColor(geometry=byStartPointDirectionLength_2, color=color_palette)

# group: Tangents as Colored Lines
color_palette_2 = ColorPalette({R: 50, G: 205, B: 50, A: 255})
byGeometryColor_2 = Modifiers.GeometryColor.ByGeometryColor(geometry=byStartPointDirectionLength, color=color_palette_2)
