# Dynamo graph 07_2d Hill Climbing N points python local solver slope START.dyn (Dynamo 2.0.3.8810)

# note: Working / Functions
# Orange indicates the working of the script. No changes should be made in these groups unless advised.
# note: Variables / Inputs
# Green indicates Variables that can be altered per project and must be set accordingly before running the script.

# group: BiLT NA 2019 How To Train Your Model 2d Hill Climbing - 5 Points
# note: REQUIRED DYNAMO PACKAGES
# None
# note: ADDITIONAL COMMENTS
# note: DYNAMO VERSION
# 2.0.2
# note: DYNAMO PROJECT
# How to Train Your Model BiLT 2019
# note: ASSOCIATED FILE(S)
# N/A
# note: AUTHOR(S) / CREATION DATE
# Matt Jezyk / June 2019
# note: DESCRIPTION
# The 2d Hill Climbing dyn will create a spline to represent a 2d landscape. Points will then be created via a Generator and the maximum height computed in the Evaluator. This graph can be used in Refinery via Randomize or Optimize to find the highest point. Note the second Evaluator for the 'Max Y Delta' - simply the sum of how far all the points move away from the origin. This can be used as a competing goal if you modify the spline landcape to make the hill to the right higher.

# group: Model Setup - Hill Creation
start_point = Point.ByCoordinates()
code_block = CodeBlock { 25; 50; 75; 200; }
# note: Checking / Outputs
# Red indicates checking nodes to ensure the script has deployed correctly.
number_slider = DoubleSlider(97.9, range=0..100 step 0.1)
point_1 = Point.ByCoordinates(y=code_block.out0, z=number_slider)
number_slider_2 = DoubleSlider(60, range=0..100 step 0.1)
point_2 = Point.ByCoordinates(y=code_block.out1, z=number_slider_2)
number_slider_3 = DoubleSlider(100, range=0..100 step 0.1)
point_3 = Point.ByCoordinates(y=code_block.out2, z=number_slider_3)
end_point = Point.ByCoordinates(y=code_block.out3)
list_create = List.Create(item0=start_point, item1=point_1, item2=point_2, item3=point_3, item4=end_point)
hill_curve = NurbsCurve.ByPoints(points=list_create)
list_create_2 = List.Create(item0=start_point, item1=end_point)
flat_line = NurbsCurve.ByPoints(points=list_create_2)

# group: Input - Vary Point Delta Y
pt_number = IntegerSlider(64, range=0..140 step 1)
pt_offset = DoubleSlider(0, range=0..10 step 0.1)

# group: Generator - Create Points
pointGenerator = Python(IN[0]=hill_curve, IN[1]=flat_line, IN[2]=pt_number, IN[3]=pt_offset)
# ---------- pointGenerator.python (17 lines) ----------
# Enable Python support and load DesignScript library
import clr
clr.AddReference('ProtoGeometry')
from Autodesk.DesignScript.Geometry import *

# The inputs to this node will be stored as a list in the IN variables.
dataEnteringNode = IN

# Place your code below this line

#PointGenerator
#How to Train Your Model BiLT NA 2019
#Jezyk


# Assign your output to the OUT variable.
OUT = [basePoints, projPoints, baseDist, segDist]
# ----------------------------------------

step_size = DoubleSlider(0.13, range=0.01..1 step 0.01)
max_iterations = IntegerSlider(0, range=0..200 step 1)  # graph input

# group: Evaluator - Find Maximum Height
localHillClimber = Python(IN[0]=pointGenerator, IN[1]=hill_curve, IN[2]=step_size, IN[3]=max_iterations)
# ---------- localHillClimber.python (19 lines) ----------
# Enable Python support and load DesignScript library
import clr
clr.AddReference('ProtoGeometry')
from Autodesk.DesignScript.Geometry import *

# The inputs to this node will be stored as a list in the IN variables.
dataEnteringNode = IN
# Place your code below this line

#How to Train Your Model BiLT NA 2019 - Jezyk
#Using Newton's Method to fomd minumum slope along a curve,
#then moving point locations closer to the min slopes based on maxIterations
#you could make this a while loop that condinues to iterate until all points are under a min slope. 

#Newton's Method in Python
#http://code.activestate.com/recipes/578419-newtons-method-to-solve-equations-in-python/


OUT = [slopesOnHill, pointsOnHill,projCircles] #pointsOnHill,
# ----------------------------------------
code_block_2 = CodeBlock(climbingResults=localHillClimber)
# ---------- code_block_2.designscript (5 lines) ----------
climbingResults;
slopes = climbingResults[0];
movedPoints = climbingResults[1];
movedPointsHeights = Point.Z(movedPoints);
movedPointsYDist = Point.Y(movedPoints);
# ----------------------------------------
sum_total_height = Math.Sum(values=code_block_2.movedPointsHeights)

# group: Evaluator - Max Delta Y
sum_total_length = Math.Sum(values=code_block_2.movedPointsYDist)

# group: Output
sumZHeights = Watch(sum_total_height)  # graph output
sumYDelta = Watch(sum_total_length)  # graph output

integer_slider = IntegerSlider(34, range=0..100 step 1)
integer_slider_2 = IntegerSlider(57, range=0..100 step 1)
newtown_s_method = Python(IN[0]=integer_slider, IN[1]=integer_slider_2)
# ---------- newtown_s_method.python (33 lines) ----------
# Enable Python support and load DesignScript library
import clr
clr.AddReference('ProtoGeometry')
from Autodesk.DesignScript.Geometry import *

# The inputs to this node will be stored as a list in the IN variables.

#How to Train Your Model BiLT NA 2019 - Jezyk
#Newton's Method in Python
#http://code.activestate.com/recipes/578419-newtons-method-to-solve-equations-in-python/

dataEnteringNode = IN
x = IN[0]
n = IN[1]


def f(x): # 
	return x**3 + x - 1
	
def f_prime(x):
	return 3*x**2 + 1
	
def newt(x,n):
	for i in range(n):
		if f_prime(x) == 0:
			return x
		x = x - f(x)/f_prime(x)
	return x

# Place your code below this line

# Assign your output to the OUT variable.
OUT = newt(x,n)
# ----------------------------------------
