# Dynamo graph 08_2d Hill Climbing N points python local solver slope FINISH.dyn (Dynamo 2.0.3.8810)

# note: Working / Functions
# Orange indicates the working of the script. No changes should be made in these groups unless advised.
# note: Variables / Inputs
# Green indicates Variables that can be altered per project and must be set accordingly before running the script.

# group: BiLT NA 2019 How To Train Your Model 2d Hill Climbing - 5 Points
# note: REQUIRED DYNAMO PACKAGES
# None
# note: ADDITIONAL COMMENTS
# note: DYNAMO VERSION
# 2.0.2
# note: DYNAMO PROJECT
# How to Train Your Model BiLT 2019
# note: ASSOCIATED FILE(S)
# N/A
# note: AUTHOR(S) / CREATION DATE
# Matt Jezyk / June 2019
# note: DESCRIPTION
# The 2d Hill Climbing dyn will create a spline to represent a 2d landscape. Points will then be created via a Generator and the maximum height computed in the Evaluator. This graph can be used in Refinery via Randomize or Optimize to find the highest point. Note the second Evaluator for the 'Max Y Delta' - simply the sum of how far all the points move away from the origin. This can be used as a competing goal if you modify the spline landcape to make the hill to the right higher.

# group: Model Setup - Hill Creation
start_point = Point.ByCoordinates()
code_block = CodeBlock { 25; 50; 75; 200; }
# note: Checking / Outputs
# Red indicates checking nodes to ensure the script has deployed correctly.
number_slider = DoubleSlider(97.9, range=0..100 step 0.1)
point_1 = Point.ByCoordinates(y=code_block.out0, z=number_slider)
number_slider_2 = DoubleSlider(60, range=0..100 step 0.1)
point_2 = Point.ByCoordinates(y=code_block.out1, z=number_slider_2)
number_slider_3 = DoubleSlider(100, range=0..100 step 0.1)
point_3 = Point.ByCoordinates(y=code_block.out2, z=number_slider_3)
end_point = Point.ByCoordinates(y=code_block.out3)
list_create = List.Create(item0=start_point, item1=point_1, item2=point_2, item3=point_3, item4=end_point)
hill_curve = NurbsCurve.ByPoints(points=list_create)
list_create_2 = List.Create(item0=start_point, item1=end_point)
flat_line = NurbsCurve.ByPoints(points=list_create_2)

# group: Input - Vary Point Delta Y
pt_number = IntegerSlider(138, range=0..140 step 1)  # graph input
pt_offset = DoubleSlider(0, range=0..10 step 0.1)

# group: Generator - Create Points
pointGenerator = Python(IN[0]=hill_curve, IN[1]=flat_line, IN[2]=pt_number, IN[3]=pt_offset)
# ---------- pointGenerator.python (38 lines) ----------
# Enable Python support and load DesignScript library
import clr
clr.AddReference('ProtoGeometry')
from Autodesk.DesignScript.Geometry import *

# The inputs to this node will be stored as a list in the IN variables.
dataEnteringNode = IN

# Place your code below this line

#PointGenerator
#How to Train Your Model BiLT NA 2019
#Jezyk

hillCurve = IN[0]
baseCurve = IN[1]
ptCount = IN[2]
ptOffset = IN[3]
zVec = Vector.ZAxis() #Vector.ByCoordinates(0,0,1) 
xVec = Vector.XAxis() #Vector.ByCoordinates(1,0,0) 

startY = baseCurve.StartPoint.Y
endY = baseCurve.EndPoint.Y
baseDist = endY - ptOffset - startY - ptOffset
segDist = baseDist/ptCount

basePoints = []
projPoints = []

for i in range(ptCount):
    basePoint = Point.ByCoordinates(0,segDist*i,0)
    basePoints.append(basePoint)
    
    projPoint = Point.Project(basePoint, hillCurve, zVec)
    projPoints.append(projPoint[0])

# Assign your output to the OUT variable.
OUT = [basePoints, projPoints, baseDist, segDist]
# ----------------------------------------

step_size = DoubleSlider(0.13, range=0.01..1 step 0.01)
max_iterations = IntegerSlider(0, range=0..200 step 1)  # graph input

# group: Evaluator - Find Maximum Height
localHillClimber = Python(IN[0]=pointGenerator, IN[1]=hill_curve, IN[2]=step_size, IN[3]=max_iterations)
# ---------- localHillClimber.python (75 lines) ----------
# Enable Python support and load DesignScript library
import clr
clr.AddReference('ProtoGeometry')
from Autodesk.DesignScript.Geometry import *

# The inputs to this node will be stored as a list in the IN variables.
dataEnteringNode = IN
# Place your code below this line

#How to Train Your Model BiLT NA 2019 - Jezyk
#Using Newton's Method to find minimum slope along a curve,
#then moving point locations closer to the min slopes based on maxIterations
#you could make this a while loop that continues to iterate until all points are under a min slope. 

#Newton's Method in Python
#http://code.activestate.com/recipes/578419-newtons-method-to-solve-equations-in-python/


generatedPoints = IN[0]
hillCurve = IN[1]
pointsOnHill = generatedPoints[1] #[0] = basePoints, [1] = projPoints

step = IN[2]/100
maxIterations = IN[3]

zVec = Vector.ZAxis()
yVec = Vector.YAxis()
xVec = Vector.XAxis()

paramsOnHill = []
vectorsOnHill = []
slopesOnHill = []
projCircles = []
zValues = []
newPointsOnHill = []


#Newtons' Method

#Eval Position on Curve, Return Height 
def f(t): # for t (t param of curve), return y height for the curve
	evalPoint = hillCurve.PointAtParameter(t)
	z = evalPoint.Z
	#zValues.append(y)
	return z

#Eval Tangent on Curve, Return Slope
def f_prime(t): # for t (t param of curve), calc tangent and return slope angle of tangent line
	tanVector = hillCurve.TangentAtParameter(t)
	#tanVectors.append(tanVector)
	slopeAngle = Vector.Dot(tanVector, Vector.ZAxis()) #zVec #Vector.XAxis())
	return slopeAngle

#Use Newtons' Method to Step Along Curve
def newtCurve(tParam, n, hillCurve, step):
	for i in range(n):
		if abs(f_prime(tParam)) < 0.5:
			return tParam
		tParam = tParam - ((f_prime(tParam + step)) - (f_prime(tParam - step)))/f_prime(tParam)
		#tParam = tParam - ((f(tParam + step)) - (f(tParam - step)))/step*10
		slopesOnHill.append(f_prime(tParam))
		zValues.append(f(tParam))
	return tParam

#Iterate Through All Points and Move Along Curve
for pt in pointsOnHill:
	paramOnHill = Curve.ParameterAtPoint(hillCurve, pt) 
	
	n = int(maxIterations)
	newT = newtCurve(paramOnHill, n, hillCurve, step)
	pt = Curve.PointAtParameter(hillCurve, newT)
	newPointsOnHill.append(pt)
	projCircle = Circle.ByCenterPointRadiusNormal(pt, 3, xVec)
	projCircles.append(projCircle)
OUT = [slopesOnHill, newPointsOnHill, projCircles] #pointsOnHill,
# ----------------------------------------
code_block_2 = CodeBlock(climbingResults=localHillClimber)
# ---------- code_block_2.designscript (5 lines) ----------
climbingResults;
slopes = climbingResults[0];
movedPoints = climbingResults[1];
movedPointsHeights = Point.Z(movedPoints);
movedPointsYDist = Point.Y(movedPoints);
# ----------------------------------------
sum_total_height = Math.Sum(values=code_block_2.movedPointsHeights)

# group: Evaluator - Max Delta Y
sum_total_length = Math.Sum(values=code_block_2.movedPointsYDist)

# group: Output
sumZHeights = Watch(sum_total_height)  # graph output
sumYDelta = Watch(sum_total_length)  # graph output

integer_slider = IntegerSlider(34, range=0..100 step 1)
integer_slider_2 = IntegerSlider(57, range=0..100 step 1)
newtown_s_method = Python(IN[0]=integer_slider, IN[1]=integer_slider_2)
# ---------- newtown_s_method.python (33 lines) ----------
# Enable Python support and load DesignScript library
import clr
clr.AddReference('ProtoGeometry')
from Autodesk.DesignScript.Geometry import *

# The inputs to this node will be stored as a list in the IN variables.

#How to Train Your Model BiLT NA 2019 - Jezyk
#Newton's Method in Python
#http://code.activestate.com/recipes/578419-newtons-method-to-solve-equations-in-python/

dataEnteringNode = IN
x = IN[0]
n = IN[1]


def f(x): # 
	return x**3 + x - 1
	
def f_prime(x):
	return 3*x**2 + 1
	
def newt(x,n):
	for i in range(n):
		if f_prime(x) == 0:
			return x
		x = x - f(x)/f_prime(x)
	return x

# Place your code below this line

# Assign your output to the OUT variable.
OUT = newt(x,n)
# ----------------------------------------
