# Dynamo graph 09_3d Surface Hill Climbing 1 point python slope calc.dyn (Dynamo 2.0.3.8810)

range = IntegerSlider(10, range=10..100 step 1)  # graph input
code_block = CodeBlock(r=range) { -r..r..#r*2; }
byCoordinates = Point.ByCoordinates(x=code_block, y=code_block, lacing=CrossProduct)
code_block_2 = CodeBlock { 1; }
flatten = List.Flatten(list=byCoordinates, amt=code_block_2)
X = Point.X(point=flatten)
Y = Point.Y(point=flatten)
amplitude = IntegerSlider(18, range=1..100 step 1)  # graph input
C = IntegerSlider(1, range=1..100 step 1)  # graph input
python_script = Python(IN[0]=amplitude, IN[1]=X, IN[2]=Y, IN[3]=C)
# ---------- python_script.python (23 lines) ----------
# Enable Python support and load DesignScript library
import clr
clr.AddReference('ProtoGeometry')
from Autodesk.DesignScript.Geometry import *
import math

amp = IN[0]
x = IN[1]
y = IN[2]
c = IN[3]

z = []

for index in range(len(x)):
	sum = math.pow(x[index],2) + math.pow(y[index],2) + math.pow(c,2)
	num1 = math.sqrt(sum)
	num2 = math.sin(num1)
	zVal = amp * num2 / num1
	
	z.append(zVal)

# Assign your output to the OUT variable.
OUT = z
# ----------------------------------------
byCoordinates_2 = Point.ByCoordinates(x=X, y=Y, z=python_script)
count = List.Count(list=byCoordinates)
chop = List.Chop(list=byCoordinates_2, lengths=count)
byControlPoints = NurbsCurve.ByControlPoints(points=chop)
byLoft = Surface.ByLoft(crossSections=byControlPoints)
area = Surface.Area(surface=byLoft)  # graph output
integer_slider = IntegerSlider(9, range=0..100 step 1)
code_block_3 = CodeBlock(curvelist=byControlPoints, i=integer_slider) { curvelist[i]; }

# group: Evaluator - Find Maximum Height
hillCurve = CodeBlock(hillCurve=code_block_3) { hillCurve; }
tGuess = DoubleSlider(0.09, range=0..1 step 0.01)
numSteps = DoubleSlider(64, range=1..200 step 1)
localHillClimber = Python(IN[0]=tGuess, IN[1]=numSteps, IN[2]=hillCurve)
# ---------- localHillClimber.python (52 lines) ----------
# Enable Python support and load DesignScript library
import clr
clr.AddReference('ProtoGeometry')
from Autodesk.DesignScript.Geometry import *

# The inputs to this node will be stored as a list in the IN variables.
dataEnteringNode = IN

tGuess = IN[0]
numSteps = IN[1]
hillCurve = IN[2]

tValues = []
yResults = []
tanVectors = []
slopeAngles = []

# Place your code below this line

#Newton's Method in Python
#http://code.activestate.com/recipes/578419-newtons-method-to-solve-equations-in-python/

def f(t): # for t (t param of curve), return y height for the curve
	evalPoint = hillCurve.PointAtParameter(t)
	y = evalPoint.Y
	yResults.append(y)
	return y
	
def f_prime(t): # for t (t param of curve), calc tangent and return slope angle of tangent line
	tanVector = hillCurve.TangentAtParameter(t)
	tanVectors.append(tanVector)
	slopeAngle = Vector.AngleWithVector(tanVector, Vector.XAxis())
	slopeAngles.append(slopeAngle)
	return slopeAngle
	
#f’’(x) = (f_prime(x + h/2) - f_prime(x - h/2))/h



def newt(t,n): # use newtons method to step along curve and find the value of t that minimizes the slope
	for i in range(n):
		if f_prime(t) == 0:
			return t
		t = t - f(t)/f_prime(t)
		tValues.append(t)
	return t # return the t value that corresponds with the minumum slope angle

result = newt(float(tGuess),int(numSteps)) # guess, num steps


# Assign your output to the OUT variable.
OUT = [result, tValues, tanVectors, slopeAngles]
# ----------------------------------------
firstItem = List.FirstItem(list=localHillClimber)
pointAtParameter = Curve.PointAtParameter(curve=hillCurve, param=firstItem)
tangentAtParameter = Curve.TangentAtParameter(curve=hillCurve, param=firstItem)
code_block_4 = CodeBlock { 100; }
byStartPointDirectionLength = Line.ByStartPointDirectionLength(startPoint=pointAtParameter, direction=tangentAtParameter, length=code_block_4)
code_block_5 = CodeBlock(newtonResults=localHillClimber)
# ---------- code_block_5.designscript (5 lines) ----------
newtonResults;
tValatMinSlope = newtonResults[0];
tValues = newtonResults[1];
tanVectors = newtonResults[2];
slopeAngles = newtonResults[3];
# ----------------------------------------
pointAtParameter_2 = Curve.PointAtParameter(curve=hillCurve, param=code_block_5.tValues, lacing=CrossProduct)
byStartPointDirectionLength_2 = Line.ByStartPointDirectionLength(startPoint=pointAtParameter_2, direction=code_block_5.tanVectors, length=code_block_4)
