# Dynamo graph 2d Hill Climbing N points python local solver height.dyn (Dynamo 2.0.3.8810)

# note: Working / Functions
# Orange indicates the working of the script. No changes should be made in these groups unless advised.
# note: Variables / Inputs
# Green indicates Variables that can be altered per project and must be set accordingly before running the script.

# group: BiLT NA 2019 How To Train Your Model 2d Hill Climbing - 5 Points
# note: REQUIRED DYNAMO PACKAGES
# None
# note: ADDITIONAL COMMENTS
# note: DYNAMO VERSION
# 2.0.2
# note: DYNAMO PROJECT
# How to Train Your Model BiLT 2019
# note: ASSOCIATED FILE(S)
# N/A
# note: AUTHOR(S) / CREATION DATE
# Matt Jezyk / June 2019
# note: DESCRIPTION
# The 2d Hill Climbing dyn will create a spline to represent a 2d landscape. Points will then be created via a Generator and the maximum height computed in the Evaluator. This graph can be used in Refinery via Randomize or Optimize to find the highest point. Note the second Evaluator for the 'Max Y Delta' - simply the sum of how far all the points move away from the origin. This can be used as a competing goal if you modify the spline landcape to make the hill to the right higher.

# group: Model Setup - Hill Creation
start_point = Point.ByCoordinates()
code_block = CodeBlock { 25; 50; 75; 100; }
# note: Checking / Outputs
# Red indicates checking nodes to ensure the script has deployed correctly.
number_slider = DoubleSlider(37.4, range=0..100 step 0.1)
point_1 = Point.ByCoordinates(y=code_block.out0, z=number_slider)
number_slider_2 = DoubleSlider(63.1, range=0..100 step 0.1)
point_2 = Point.ByCoordinates(y=code_block.out1, z=number_slider_2)
number_slider_3 = DoubleSlider(48.1, range=0..100 step 0.1)
point_3 = Point.ByCoordinates(y=code_block.out2, z=number_slider_3)
number_slider_4 = DoubleSlider(0, range=0..100 step 0.1)
end_point = Point.ByCoordinates(y=code_block.out3, z=number_slider_4)
list_create = List.Create(item0=start_point, item1=point_1, item2=point_2, item3=point_3, item4=end_point)
hill_curve = NurbsCurve.ByPoints(points=list_create)
list_create_2 = List.Create(item0=start_point, item1=end_point)
flat_line = NurbsCurve.ByPoints(points=list_create_2)

# group: Input - Vary Point Delta Y
pt_number = IntegerSlider(70, range=0..70 step 1)  # graph input
pt_seed = DoubleSlider(20, range=0..20 step 0.1)  # graph input

# group: Generator - Create Points
generatedPoints = Python(IN[0]=hill_curve, IN[1]=flat_line, IN[2]=pt_number, IN[3]=pt_seed)
# ---------- generatedPoints.python (33 lines) ----------
# Enable Python support and load DesignScript library
import clr
clr.AddReference('ProtoGeometry')
from Autodesk.DesignScript.Geometry import *

# The inputs to this node will be stored as a list in the IN variables.
dataEnteringNode = IN

# Place your code below this line

hillCurve = IN[0]
baseCurve = IN[1]
ptCount = IN[2]
ptSeed = IN[3]
zVec = Vector.ByCoordinates(0,0,1) #Vector.ZAxis
xVec = Vector.ByCoordinates(1,0,0) #Vector.XAxis

startX = baseCurve.StartPoint.X
endX = baseCurve.EndPoint.X

basePoints = []
projPoints = []
projCircles = []

for i in range(ptCount):
    basePoint = Point.ByCoordinates(0,ptSeed+i,0)
    basePoints.append(basePoint)
    
    projPoint = Point.Project(basePoint, hillCurve, zVec)
    projPoints.append(projPoint[0])

# Assign your output to the OUT variable.
OUT = [basePoints, projPoints]
# ----------------------------------------

step_size = DoubleSlider(0.1, range=0.1..1 step 0.05)
max_integer = IntegerSlider(0, range=0..200 step 1)  # graph input

# group: Evaluator - Find Maximum Height
localHillClimber = Python(IN[0]=generatedPoints, IN[1]=hill_curve, IN[2]=step_size, IN[3]=max_integer)
# ---------- localHillClimber.python (102 lines) ----------
# Enable Python support and load DesignScript library
import clr
clr.AddReference('ProtoGeometry')
from Autodesk.DesignScript.Geometry import *

# The inputs to this node will be stored as a list in the IN variables.
dataEnteringNode = IN
# Place your code below this line
generatedPoints = IN[0]
hillCurve = IN[1]
pointsOnHill = generatedPoints[1] #[0] = basePoints, [1] = projPoints

step = IN[2]/100
maxIterations = IN[3]

zVec = Vector.ByCoordinates(0,0,1) #Vector.ZAxis
yVec = Vector.ByCoordinates(0,1,0) #Vector.YAxis
xVec = Vector.ByCoordinates(1,0,0) #Vector.XAxis

paramsOnHill = []
vectorsOnHill = []
slopesOnHill = []
projCircles = []
zDirections = []
newPointsOnHill = []
#step = .05



#newtons' method

def calcHeight(tParam, hillCurve):
	calcPt = Curve.PointAtParameter(hillCurve, tParam)
	return calcPt.Z

def calcMaxHeight(hillCurve):
	heights = []
	for i in range(0, 100, 1):
		calcPt = Curve.PointAtParameter(hillCurve, i/100)
		heights.append(calcPt.Z)
	return max(heights)
	

	
def calcTangent(tParam, hillCurve):
	return Curve.TangentAtParameter(hillCurve, tParam)
	
def calcSlope(tangent):
	zVec = Vector.ByCoordinates(0,0,1)
	return Vector.Dot(tangent, zVec)

def newtCurve(tParam, n, hillCurve, flip, step):
	if flip:
		step = -step
	else:
		step = step
	for i in range(n):
		#SLOPE
		if abs(calcSlope(calcTangent(tParam, hillCurve))) < .5:
			return tParam
		tParam = tParam - (calcSlope(calcTangent(tParam + step, hillCurve)) - (calcSlope(calcTangent(tParam - step, hillCurve))))/calcSlope(calcTangent(tParam, hillCurve))
		
		#HEIGHT
		#maxHeight = calcMaxHeight(hillCurve)
		#if (calcHeight(tParam, hillCurve) ) >= 40:
		#	return tParam
		#tParam = tParam - (calcHeight(tParam + step, hillCurve) - calcHeight(tParam - step, hillCurve))/calcHeight(tParam, hillCurve)
	return tParam



for pt in pointsOnHill:
	paramOnHill = Curve.ParameterAtPoint(hillCurve, pt)
	paramsOnHill.append(paramOnHill)
	vectorOnHill = Curve.TangentAtParameter(hillCurve, paramOnHill)
	vectorsOnHill.append(vectorOnHill)
	#slope = Vector.AngleWithVector(vectorOnHill,xVec)
	slope = Vector.Dot(vectorOnHill,zVec)
	slopesOnHill.append(slope)    
	n = int(maxIterations)
	newT = newtCurve(paramOnHill, n, hillCurve, 0, step)
	pt = Curve.PointAtParameter(hillCurve, newT)
	
	#if (slope > 0):
	#	zDirection = 1
	#	#move x value forward to go up
	#	#newT = paramOnHill + step
	#	newT = newtCurve(paramOnHill, n, hillCurve, 1, step)
	#	pt = Curve.PointAtParameter(hillCurve, newT)
	#	
	#elif(slope < 0):
	#	zDirection = 0
	#	#move x value forward to go up
	#	#newT = paramOnHill - step
	#	newT = newtCurve(paramOnHill, n, hillCurve, 1, step)
	#	pt = Curve.PointAtParameter(hillCurve, newT)
	##zDirections.append(zDirection)
	##newPointsOnHill.append(newPt)
	
	projCircle = Circle.ByCenterPointRadiusNormal(pt, 3, xVec)
	projCircles.append(projCircle)
OUT = [slopesOnHill, pointsOnHill, projCircles] #
# ----------------------------------------
code_block_2 = CodeBlock(climbingResults=localHillClimber) { climbingResults; movedPoints = climbingResults[1]; movedPointsHeights = Point.Z(movedPoints); }
sum_total_height = Math.Sum(values=code_block_2.movedPointsHeights)

code_block_3 = CodeBlock(generatedPoints=generatedPoints) { projectedPoints = generatedPoints[1]; Point.Y(projectedPoints); }

# group: Evaluator - Max Delta Y
sum_total_length = Math.Sum(values=code_block_3.out1)

# group: Output
sumZHeights = Watch(sum_total_height)  # graph output
sumYDelta = Watch(sum_total_length)  # graph output

code_block_4 = CodeBlock { 45; }
integer_slider = IntegerSlider(34, range=0..100 step 1)
integer_slider_2 = IntegerSlider(44, range=0..100 step 1)
newtown_s_method = Python(IN[0]=integer_slider, IN[1]=integer_slider_2)
# ---------- newtown_s_method.python (28 lines) ----------
# Enable Python support and load DesignScript library
import clr
clr.AddReference('ProtoGeometry')
from Autodesk.DesignScript.Geometry import *

# The inputs to this node will be stored as a list in the IN variables.
dataEnteringNode = IN
x = IN[0]
n = IN[1]


def f(x): # 
	return x**3 + x - 1
	
def f_prime(x):
	return 3*x**2 + 1
	
def newt(x,n):
	for i in range(n):
		if f_prime(x) == 0:
			return x
		x = x - f(x)/f_prime(x)
	return x

# Place your code below this line

# Assign your output to the OUT variable.
OUT = newt(x,n)
# ----------------------------------------
