# Dynamo graph 3d Surface Hill Climbing 1 point python.dyn "PointPlotting" (Dynamo 2.0.2.6826)

range = IntegerSlider(10, range=10..100 step 1)  # graph input
code_block = CodeBlock(r=range) { -r..r..#r*2; }
byCoordinates = Point.ByCoordinates(x=code_block, y=code_block, lacing=CrossProduct)
code_block_2 = CodeBlock { 1; }
flatten = List.Flatten(list=byCoordinates, amt=code_block_2)
X = Point.X(point=flatten)
Y = Point.Y(point=flatten)
amplitude = IntegerSlider(18, range=1..100 step 1)  # graph input
C = IntegerSlider(1, range=1..100 step 1)  # graph input
python_script = Python(IN[0]=amplitude, IN[1]=X, IN[2]=Y, IN[3]=C)
# ---------- python_script.python (23 lines) ----------
# Enable Python support and load DesignScript library
import clr
clr.AddReference('ProtoGeometry')
from Autodesk.DesignScript.Geometry import *
import math

amp = IN[0]
x = IN[1]
y = IN[2]
c = IN[3]

z = []

for index in range(len(x)):
	sum = math.pow(x[index],2) + math.pow(y[index],2) + math.pow(c,2)
	num1 = math.sqrt(sum)
	num2 = math.sin(num1)
	zVal = amp * num2 / num1
	
	z.append(zVal)

# Assign your output to the OUT variable.
OUT = z
# ----------------------------------------
byCoordinates_2 = Point.ByCoordinates(x=X, y=Y, z=python_script)
count = List.Count(list=byCoordinates)
chop = List.Chop(list=byCoordinates_2, lengths=count)
byControlPoints = NurbsCurve.ByControlPoints(points=chop)
byLoft = Surface.ByLoft(crossSections=byControlPoints)
area = Surface.Area(surface=byLoft)  # graph output
