# Dynamo custom node PointOnHill.dyf (Dynamo 2.0.2.6826)
# category: mdj

curve = Input(curve: Autodesk.DesignScript.Geometry.Curve)
list = Input(list: var[]..[])
pointAtParameter = Curve.PointAtParameter(curve=curve, param=list)
X = Point.X(point=pointAtParameter)
Y = Point.Y(point=pointAtParameter)
list_2 = Input(list: var[]..[])
add = Y + list_2
Z = Point.Z(point=pointAtParameter)
byCoordinates = Point.ByCoordinates(y=add, z=Z)
curve_2 = Input(curve: Autodesk.DesignScript.Geometry.Curve)
ZAxis = Vector.ZAxis()
project = Point.Project(point=byCoordinates, baseGeometry=curve_2, projectionDirection=ZAxis)
Z_2 = Point.Z(point=project)
code_block = CodeBlock { 1; 3; }
flatten = List.Flatten(list=Z_2, amt=code_block.out0)
var = Output(flatten)  # "var[]..[]"
XAxis = Vector.XAxis()
byCenterPointRadiusNormal = Circle.ByCenterPointRadiusNormal(centerPoint=project, radius=code_block.out1, normal=XAxis)
var_2 = Output(byCenterPointRadiusNormal)  # "var[]..[]"
var_3 = Output(project)  # "var[]..[]"
var_4 = Output(byCoordinates)  # "var[]..[]"
