# Dynamo graph pointPlotterPython.dyn (Dynamo 2.0.3.8810)

guess = DoubleSlider(0, range=0..100 step 0.1)
yRangeLimit = IntegerSlider(41, range=0..100 step 1)
numSteps = IntegerSlider(100, range=0..100 step 1)
offset = DoubleSlider(0, range=0..100 step 0.1)
functionPlotter = Python(IN[0]=guess, IN[1]=yRangeLimit, IN[2]=numSteps, IN[3]=offset)
# ---------- functionPlotter.python (54 lines) ----------
# Enable Python support and load DesignScript library
import clr
clr.AddReference('ProtoGeometry')
from Autodesk.DesignScript.Geometry import *

# The inputs to this node will be stored as a list in the IN variables.
dataEnteringNode = IN

xGuess = IN[0]
yRangeLimit = IN[1]
numSteps = IN[2]
offset = IN[3]

# Place your code below this line

#Newton's Method in Python
#http://code.activestate.com/recipes/578419-newtons-method-to-solve-equations-in-python/

def f(x):
	return (x**3 + x)/10 - offset
	
def f_prime(x):
	return 3*x**2 + 1
	
#f’(x) = (f(x + h/2) - f(x - h/2))/h



def newt(x,n):
	for i in range(n):
		if f_prime(x) == 0:
			return x
		x = x - f(x)/f_prime(x)
	return x
	

xPositions = []
yPositions = []


for i in range(-yRangeLimit,yRangeLimit,1):
    x = i/float(10.0) # scale range down to avoid limits and infinity
    y = f(x)
    xPositions.append(x)
    yPositions.append(y)
    #print('i: {0} x: {1} y: {2}'.format(i, x, y))

#print('The root is: ')
result = newt(float(xGuess),int(numSteps)) # guess, num steps
#print(result)


# Assign your output to the OUT variable.
OUT = [xPositions, yPositions, result]
# ----------------------------------------
code_block = CodeBlock(calcPoints=functionPlotter)
# ---------- code_block.designscript (5 lines) ----------
calcPoints;
xPositions = calcPoints[0];
yPositions = calcPoints[1];
Point.ByCoordinates(xPositions,yPositions);
root = calcPoints[2];
# ----------------------------------------
watch = Watch(code_block.root)
formula = Formula("x^3 + x - offset")  # unwired: x, offset
byPoints = NurbsCurve.ByPoints(points=code_block.out3)
t_param = DoubleSlider(0, range=0..1 step 0.01)
code_block_2 = CodeBlock(x=t_param) { x; 0; }
byTangency = Line.ByTangency(curve=byPoints, parameter=code_block_2.x)
ZAxis = Vector.ZAxis()
code_block_3 = CodeBlock { 0.1; }
extrude = Curve.Extrude(curve=byPoints, direction=ZAxis, distance=code_block_3)
pointAtParameter = Surface.PointAtParameter(surface=extrude, u=code_block_2.x, v=code_block_2.out1, lacing=CrossProduct)
derivativesAtParameter = Surface.DerivativesAtParameter(surface=extrude, u=code_block_2.x, v=code_block_2.out1, lacing=CrossProduct)
transpose = List.Transpose(lists=derivativesAtParameter)
firstItem = List.FirstItem(list=transpose)
code_block_4 = CodeBlock { 3; }
byStartPointDirectionLength = Line.ByStartPointDirectionLength(startPoint=pointAtParameter, direction=firstItem, length=code_block_4)
pointAtParameter_2 = Curve.PointAtParameter(curve=byPoints, param=code_block_2.x)
XAxis = Vector.XAxis()
angleWithVector = Vector.AngleWithVector(vector=firstItem, otherVector=XAxis)
angle_from_horizontal = Watch(angleWithVector)
