# Dynamo graph BuildingMasser-2programsBiLT_NA2019-new-evaluator-office-tower-FINISH.dyn "BuildingMasser-2programsBiLT_NA2019-mdj-new-evaluator-office-tower" (Dynamo 2.0.3.8810)

# note: Checking / Outputs
# Orange indicates analaysis nodes to measure outcomes.
# note: Working / Functions
# Green indicates the working of the script. No changes should be made in these groups unless advised.
# note: Variables / Inputs
# Pink indicates Variables that can be altered per project and must be set accordingly before running the script.
# note: Revit Output
# Grey indicates notes that are used for creating and updating Revit elements.

# group: URBAN BUILDING MASSER Refinery Graph Example
# note: DYNAMO PROJECT
# BuildingMasser.dyn
# note: ASSOCIATED FILES
# UrbanBuildingSite.rvt
# note: AUTHORS / CREATION DATE
# Autodesk Refinery Team, January 2019
# note: DESCRIPTION
# This parametric system allows users to study massing and programmatic distributions for an urban site. Users can select a site boundary and urban context in Revit. Users can also calibrate parameters representing program, cost, and value factors for the project. Using Refinery, the user can process options to explore possible configurations of the massing on the site.
# Variable Inputs:
# 1. ratio of retail to office area for a fixed input gross area
# 2. program block dimensions
# 3. program block rotation
# Goals:
# 1. Minimize the number of clashes
# 2. Minimize the cost
# 3. Maximize the total value per year
# note: DYNAMO VERSION
# 2.0.2
# note: REQUIRED DYNAMO PACKAGES
# None
# Does require Dynamo for Revit if you want to change the input geometry.
# note: ADDITIONAL COMMENTS
# NA

# group: Select Urban Context from Revit
# note: Select a Revit mass representing the urban context.
select_model_element = DSModelElementSelection()  # 1 picked in the model

# group: Select Site Volume from Revit
# note: Select a Revit mass representing the volumetric constraints of a site (heights, setbacks, etc)
select_model_element_2 = DSModelElementSelection()  # 1 picked in the model

# group: FUNCTION - Revit Geometry Solids
solids = Element.Solids(element=select_model_element)
remember = Data.Remember(solids)
solids_2 = Element.Solids(element=select_model_element_2)
remember_2 = Data.Remember(solids_2)
byUnion = Solid.ByUnion(solids=remember_2)

# group: Geometry: Site Context
number = DoubleInput(40)
number_2 = DoubleInput(255)
byARGB = Color.ByARGB(a=number, r=number_2, g=number_2, b=number_2)
byGeometryColor = Modifiers.GeometryColor.ByGeometryColor(geometry=remember, color=byARGB)

# group: Geometry: Zoning Boundary
bySolid = PolySurface.BySolid(solid=byUnion)
surfaces = PolySurface.Surfaces(polySurface=bySolid)
perimeterCurves = Surface.PerimeterCurves(surface=surfaces)
number_3 = DoubleInput(255)
number_4 = DoubleInput(115)
byARGB_2 = Color.ByARGB(r=number_3, b=number_4)
byGeometryColor_2 = Modifiers.GeometryColor.ByGeometryColor(geometry=perimeterCurves, color=byARGB_2)

# group: Geometry: Site Outline
bySolid_2 = PolySurface.BySolid(solid=byUnion)
surfaces_2 = PolySurface.Surfaces(polySurface=bySolid_2)
number_5 = DoubleInput(0.5)
pointAtParameter = Surface.PointAtParameter(surface=surfaces_2, u=number_5, v=number_5)
Z = Point.Z(point=pointAtParameter)
sortByKey = List.SortByKey(list=surfaces_2, keys=Z)
number_6 = DoubleInput(0)
getItemAtIndex = List.GetItemAtIndex(list=sortByKey.sorted_list, index=number_6)

# group: INPUTS Non-Varying Retail
retail_baseuposition = DoubleSlider(0.5, range=0..1 step 0.001)
retail_basevposition = DoubleSlider(0.5, range=0..1 step 0.001)

# group: INPUTS Variable retail position and rotation
retail_base_width = DoubleSlider(172.154, range=100..200 step 0.001)  # graph input
retail_baselength = DoubleSlider(144.539, range=100..200 step 0.001)  # graph input
retail_rotation = DoubleSlider(20.6, range=0..90 step 0.1)  # graph input

# group: INPUT - Program Area Distributions
gross_sq_ft = DoubleInput(1000000)
# note: Users can set a gross square area and choose how to distribute the program among the 2 building masses
retail = DoubleSlider(0.1, range=0.1..0.5 step 0.1)  # graph input
code_block = CodeBlock(area=gross_sq_ft, percentage=retail) { retail = area*percentage; office = area - retail; sum = retail + office; }
check_the_sum = Watch(code_block.sum)

# group: Total Retail Area
retail_area = Watch(code_block.retail)

# group: Retail Metrics
# note: Users can input cost and value factors for measuring and comparing options. Each program type may have its own cost and value return considerations.
# note: Several factors may contribute to increased value of a floor pertaining to a program type. For example, offices that are higher, may be more valuable but retail that is higher (farther from the street) may be less valuable.  Certain orientations towards certain views may be more valuable.  These bonuses are calculated after some geometric analyis of the mass.
retail_metrics = CodeBlock()
# ---------- retail_metrics.designscript (9 lines) ----------
CostPerSF=180;
FloorToFloor=14;
RevenuePerSFPerYear=35;
ValueBonusElevation1=1;
 //0-50;
ValueBonusElevation2=0.25;
//51-150;
ValueBonusElevation3=0.1;
//151+;
# ----------------------------------------

# group: Create geometry for retail block
pointAtParameter_2 = Surface.PointAtParameter(surface=getItemAtIndex, u=retail_baseuposition, v=retail_basevposition)
# note: A rectangular mass is created with a postion on the site. Floors are also derived from this mass using a floor-floor measurement and driven by the desired area of the program.
byOriginNormal = Plane.ByOriginNormal(origin=pointAtParameter_2)
byWidthLength = Rectangle.ByWidthLength(plane=byOriginNormal, width=retail_base_width, length=retail_baselength)
ZAxis = Vector.ZAxis()
mul = retail_base_width * retail_baselength
div = retail_area / mul
mul_2 = div * retail_metrics.FloorToFloor
extrudeAsSolid = Curve.ExtrudeAsSolid(curve=byWidthLength, direction=ZAxis, distance=mul_2)
rotate = Geometry.Rotate(geometry=extrudeAsSolid, origin=pointAtParameter_2, axis=ZAxis, degrees=retail_rotation)
X = Point.X(point=pointAtParameter_2)
Y = Point.Y(point=pointAtParameter_2)
Z_2 = Point.Z(point=pointAtParameter_2)
sequence = Sequence(start=Z_2, amount=div, step=retail_metrics.FloorToFloor)
byCoordinates = Point.ByCoordinates(x=X, y=Y, z=sequence)
ZAxis_2 = Vector.ZAxis()
byOriginNormal_2 = Plane.ByOriginNormal(origin=byCoordinates, normal=ZAxis_2)
intersect = Geometry.Intersect(geometry=rotate, other=byOriginNormal_2@L1)
extrude = Curve.Extrude(curve=byWidthLength, distance=mul_2)
area = Surface.Area(surface=extrude)

# group: Control retail geometry display
color_palette = ColorPalette({R: 255, G: 140, B: 0, A: 255})
byGeometryColor_3 = Modifiers.GeometryColor.ByGeometryColor(geometry=intersect, color=color_palette)
perimeterCurves_2 = Surface.PerimeterCurves(surface=intersect)
color_palette_2 = ColorPalette({R: 255, G: 255, B: 255, A: 255})
byGeometryColor_4 = Modifiers.GeometryColor.ByGeometryColor(geometry=perimeterCurves_2, color=color_palette_2)

# group: Find the upper surface of the retail block for stacking
# note: The top surface is identified to drive subsequent stacking of other masses.
bySolid_3 = PolySurface.BySolid(solid=rotate)
surfaces_3 = PolySurface.Surfaces(polySurface=bySolid_3)
number_7 = DoubleInput(0.5)
pointAtParameter_3 = Surface.PointAtParameter(surface=surfaces_3, u=number_7, v=number_7)
Z_3 = Point.Z(point=pointAtParameter_3)
sortByKey_2 = List.SortByKey(list=surfaces_3, keys=Z_3)
reverse = List.Reverse(list=sortByKey_2.sorted_list)
number_8 = DoubleInput(0)
getItemAtIndex_2 = List.GetItemAtIndex(list=reverse, index=number_8)

# group: INPUTS: Non-Variable Office Position
in_program2_baseuposition = DoubleSlider(0.5, range=0..1 step 0.001)
in_program2_basevposition = DoubleSlider(0.5, range=0..1 step 0.001)

# group: INPUTS: Variable Office position and rotation
input_program_2_base_width_feet = DoubleSlider(103.059, range=100..200 step 0.001)  # graph input
input_program_2_base_length_feet = DoubleSlider(190.143, range=100..200 step 0.001)  # graph input
input_program_2_mass_rotation = DoubleSlider(85.1, range=0..90 step 0.1)  # graph input

# group: Total Office Area
office_area = Watch(code_block.office)

# group: Office Metrics
# note: Users can input cost and value factors for measuring and comparing options. Each program type may have its own cost and value return considerations.
# note: Several factors may contribute to increased value of a floor pertaining to a program type. For example, offices that are higher, may be more valuable but retail that is higher (farther from the street) may be less valuable.  Certain orientations towards certain views may be more valuable.  These bonuses are calculated after some geometric analyis of the mass.
office_metrics = CodeBlock()
# ---------- office_metrics.designscript (15 lines) ----------
CostPerSF=300;
FloorToFloor=15;
RevenuePerSFPerYear=25;
ValueBonusElevation1=1;
 //0-50;
ValueBonusElevation2=1.2;
//51-150;
ValueBonusElevation3=1.5;
//151+;
ValueBonusOrientation1=1;
//0-20;
ValueBonusOrientation2=1.2;
//21-40;
ValueBonusOrientation3=1.5;
//41+;
# ----------------------------------------

# group: Create geometry for office block
pointAtParameter_4 = Surface.PointAtParameter(surface=getItemAtIndex_2, u=in_program2_baseuposition, v=in_program2_basevposition)
byOriginNormal_3 = Plane.ByOriginNormal(origin=pointAtParameter_4)
byWidthLength_2 = Rectangle.ByWidthLength(plane=byOriginNormal_3, width=input_program_2_base_width_feet, length=input_program_2_base_length_feet)
ZAxis_3 = Vector.ZAxis()
mul_3 = input_program_2_base_width_feet * input_program_2_base_length_feet
div_2 = office_area / mul_3
mul_4 = div_2 * office_metrics.FloorToFloor
extrudeAsSolid_2 = Curve.ExtrudeAsSolid(curve=byWidthLength_2, direction=ZAxis_3, distance=mul_4)
rotate_2 = Geometry.Rotate(geometry=extrudeAsSolid_2, origin=pointAtParameter_4, axis=ZAxis_3, degrees=input_program_2_mass_rotation)
X_2 = Point.X(point=pointAtParameter_4)
Y_2 = Point.Y(point=pointAtParameter_4)
Z_4 = Point.Z(point=pointAtParameter_4)
sequence_2 = Sequence(start=Z_4, amount=div_2, step=office_metrics.FloorToFloor)
byCoordinates_2 = Point.ByCoordinates(x=X_2, y=Y_2, z=sequence_2)
ZAxis_4 = Vector.ZAxis()
byOriginNormal_4 = Plane.ByOriginNormal(origin=byCoordinates_2, normal=ZAxis_4)
intersect_2 = Geometry.Intersect(geometry=rotate_2, other=byOriginNormal_4@L1)
extrude_2 = Curve.Extrude(curve=byWidthLength_2, distance=mul_4)
area_2 = Surface.Area(surface=extrude_2)

# group: Control office geometry display
color_palette_3 = ColorPalette({R: 127, G: 255, B: 0, A: 255})
byGeometryColor_5 = Modifiers.GeometryColor.ByGeometryColor(geometry=intersect_2, color=color_palette_3)
perimeterCurves_3 = Surface.PerimeterCurves(surface=intersect_2)
color_palette_4 = ColorPalette({R: 245, G: 255, B: 250, A: 255})
byGeometryColor_6 = Modifiers.GeometryColor.ByGeometryColor(geometry=perimeterCurves_3, color=color_palette_4)

# group: Retail: Total Cost
mul_5 = retail_area * retail_metrics.CostPerSF

# group: Office: Total Cost
mul_6 = office_area * office_metrics.CostPerSF

# group: Calculate amount of value generated per year in the retail block
# note: This section computes the value generated by the program over 1 year. Bonus factors are also applied.
flatten = List.Flatten(list=intersect)
area_3 = Surface.Area(surface=flatten)
mul_7 = area_3 * retail_metrics.RevenuePerSFPerYear
number_9 = DoubleInput(0.5)
pointAtParameter_5 = Surface.PointAtParameter(surface=flatten, u=number_9, v=number_9)
Z_5 = Point.Z(point=pointAtParameter_5)
python_script = Python(IN[0]=Z_5)
# ---------- python_script.python (17 lines) ----------
# Enable Python support and load DesignScript library
import clr
clr.AddReference('ProtoGeometry')
from Autodesk.DesignScript.Geometry import *

# The inputs to this node will be stored as a list in the IN variables.
dataEnteringNode = IN[0]

bools = []
# Place your code below this line
for val in dataEnteringNode:
	if val >= 0 and val < 50:
		bools.append(True)
	else:
		bools.append(False)
		
OUT = bools
# ----------------------------------------
filterByBoolMask = List.FilterByBoolMask(list=mul_7, mask=python_script)
mul_8 = filterByBoolMask.in * retail_metrics.ValueBonusElevation1
python_script_2 = Python(IN[0]=Z_5)
# ---------- python_script_2.python (17 lines) ----------
# Enable Python support and load DesignScript library
import clr
clr.AddReference('ProtoGeometry')
from Autodesk.DesignScript.Geometry import *

# The inputs to this node will be stored as a list in the IN variables.
dataEnteringNode = IN[0]

bools = []
# Place your code below this line
for val in dataEnteringNode:
	if val >= 51 and val < 150:
		bools.append(True)
	else:
		bools.append(False)
		
OUT = bools
# ----------------------------------------
filterByBoolMask_2 = List.FilterByBoolMask(list=mul_7, mask=python_script_2)
mul_9 = filterByBoolMask_2.in * retail_metrics.ValueBonusElevation2
python_script_3 = Python(IN[0]=Z_5)
# ---------- python_script_3.python (17 lines) ----------
# Enable Python support and load DesignScript library
import clr
clr.AddReference('ProtoGeometry')
from Autodesk.DesignScript.Geometry import *

# The inputs to this node will be stored as a list in the IN variables.
dataEnteringNode = IN[0]

bools = []
# Place your code below this line
for val in dataEnteringNode:
	if val >= 151:
		bools.append(True)
	else:
		bools.append(False)
		
OUT = bools
# ----------------------------------------
filterByBoolMask_3 = List.FilterByBoolMask(list=mul_7, mask=python_script_3)
mul_10 = filterByBoolMask_3.in * retail_metrics.ValueBonusElevation3
list_create = List.Create(item0=mul_8, item1=mul_9, item2=mul_10)
flatten_2 = List.Flatten(list=list_create)
sum = Math.Sum(values=flatten_2)

# group: Calculate value generated per year by the office block
flatten_3 = List.Flatten(list=intersect_2)
area_4 = Surface.Area(surface=flatten_3)
mul_11 = area_4 * office_metrics.RevenuePerSFPerYear
number_10 = DoubleInput(0.5)
pointAtParameter_6 = Surface.PointAtParameter(surface=flatten_3, u=number_10, v=number_10)
Z_6 = Point.Z(point=pointAtParameter_6)
python_script_4 = Python(IN[0]=Z_6)  # same code as python_script
filterByBoolMask_4 = List.FilterByBoolMask(list=mul_11, mask=python_script_4)
mul_12 = filterByBoolMask_4.in * office_metrics.ValueBonusElevation1
python_script_5 = Python(IN[0]=Z_6)  # same code as python_script_2
filterByBoolMask_5 = List.FilterByBoolMask(list=mul_11, mask=python_script_5)
mul_13 = filterByBoolMask_5.in * office_metrics.ValueBonusElevation2
python_script_6 = Python(IN[0]=Z_6)  # same code as python_script_3
filterByBoolMask_6 = List.FilterByBoolMask(list=mul_11, mask=python_script_6)
mul_14 = filterByBoolMask_6.in * office_metrics.ValueBonusElevation3
list_create_2 = List.Create(item0=mul_12, item1=mul_13, item2=mul_14)
python_script_7 = Python(IN[0]=input_program_2_mass_rotation, IN[1]=office_metrics.ValueBonusOrientation1, IN[2]=office_metrics.ValueBonusOrientation2, IN[3]=office_metrics.ValueBonusOrientation3)
# ---------- python_script_7.python (18 lines) ----------
# Enable Python support and load DesignScript library
import clr
clr.AddReference('ProtoGeometry')
from Autodesk.DesignScript.Geometry import *

# The inputs to this node will be stored as a list in the IN variables.
val = IN[0]
mult1 = IN[1]
mult2 = IN[2]
mult3 = IN[3]

# Place your code below this line
if val >= 0 and val < 20:
	OUT = mult1
elif val >= 21 and val < 40:
	OUT = mult2
elif val >= 41:
	OUT = mult2
# ----------------------------------------
mul_15 = list_create_2 * python_script_7
flatten_4 = List.Flatten(list=mul_15)
sum_2 = Math.Sum(values=flatten_4)

# group: INTEGRATE - Revit Output
list_create_3 = List.Create(item0=intersect, item1=intersect_2)
flatten_5 = List.Flatten(list=list_create_3)
perimeterCurves_4 = Surface.PerimeterCurves(surface=flatten_5)
byJoinedCurves = PolyCurve.ByJoinedCurves(curves=perimeterCurves_4)
floor_types = FloorTypes(index=2)
number_11 = DoubleInput(0.5)
pointAtParameter_7 = Surface.PointAtParameter(surface=flatten_5, u=number_11, v=number_11)
Z_7 = Point.Z(point=pointAtParameter_7)
string = StringInput("Mass_Level_")
number_12 = DoubleInput(1)
count = List.Count(list=flatten_5)
sequence_3 = Sequence(start=number_12, amount=count)
string_from_object = FromObject(obj=sequence_3)
code_block_2 = CodeBlock(LevelName=string, LevelNo=string_from_object) { LevelName + LevelNo; }
byElevationAndName = Level.ByElevationAndName(elevation=Z_7, name=code_block_2)
byOutlineTypeAndLevel = Floor.ByOutlineTypeAndLevel(outline=byJoinedCurves, floorType=floor_types, level=byElevationAndName)

# group: Calculate volume outside zoning boundary
code_block_3 = CodeBlock(zoningboundary=byUnion, retailblock=rotate, officeblock=rotate_2) { zoningboundary; retailblock; officeblock; }
union = Solid.Union(solid=code_block_3.retailblock, solid_2=code_block_3.officeblock)
difference = Solid.Difference(solid=union, other=code_block_3.zoningboundary)
volume = Solid.Volume(solid=difference@L1)
code_block_4 = CodeBlock { 0; }
getItemAtIndex_3 = List.GetItemAtIndex(list=volume, index=code_block_4)
code_block_5 = CodeBlock { 30; }
byARGB_3 = Color.ByARGB(a=code_block_5)
byGeometryColor_7 = Modifiers.GeometryColor.ByGeometryColor(geometry=difference, color=byARGB_3)

# group: OUTPUT - Overall Metrics
output_program_1_building_cost = Watch(mul_5)
output_program_2_building_cost = Watch(mul_6)
list_create_4 = List.Create(item0=output_program_1_building_cost, item1=output_program_2_building_cost)
sum_3 = Math.Sum(values=list_create_4)
totCost = Watch(sum_3)  # graph output
# note: The overall metrics show aggregate clashes, cost, and value generated. These metrics can be used as fitness functions for Refinery to evaluate.
output_program_1_value_generated = Watch(sum)
output_program_2_value_generated = Watch(sum_2)
list_create_5 = List.Create(item0=output_program_1_value_generated, item1=output_program_2_value_generated)
sum_4 = Math.Sum(values=list_create_5)
totvalue_yr = Watch(sum_4)  # graph output
div_3 = totCost / totvalue_yr
yrsToPayback = Watch(div_3)
output_program_1_ext_surface = Watch(area)  # "OUTPUT - Program 1 - Ext. Surface Area"
output_program_2_ext_surface = Watch(area_2)  # "OUTPUT - Program 2 - Ext. Surface Area"
list_create_6 = List.Create(item0=output_program_1_ext_surface, item1=output_program_2_ext_surface)
sum_5 = Math.Sum(values=list_create_6)
totExtSurfArea = Watch(sum_5)
volumeOutsideZoning = Watch(getItemAtIndex_3)  # graph output

viewpoints = Filename("..\03.5_StealthyRoofscapes\resource\1-points - Copy.sat")
viewpoints_2 = Geometry.ImportFromSAT(filePath=viewpoints)

# group: Translate Viewpoints to Chosen Eye Level
eyepoint_above_plane = CodeBlock { 2; -150; }
translate = Geometry.Translate(geometry=viewpoints_2, yTranslation=eyepoint_above_plane.out1, zTranslation=eyepoint_above_plane.out0)

code_block_6 = CodeBlock { 10; }
scale = Geometry.Scale(geometry=translate, amount=code_block_6)

# group: Viewpoint Selection Limit
# note: Limits the number of viewpoints that are tested to keep computation time down for testing
code_block_7 = CodeBlock(x=scale) { x[3..33..2]; x; }

code_block_8 = CodeBlock(buildingGeometry=rotate_2) { buildingGeometry; }
code_block_9 = CodeBlock { 2; }
flatten_6 = List.Flatten(list=code_block_8, amt=code_block_9)

# group: Get Normal for each Face
faces = Topology.Faces(topology=flatten_6)
code_block_10 = CodeBlock { 0.5; }

flatten_7 = List.Flatten(list=faces, amt=code_block_9)

# group (continued): Get Normal for each Face
surfaceGeometry = Face.SurfaceGeometry(face=flatten_7)
normalAtParameter = Surface.NormalAtParameter(surface=surfaceGeometry, u=code_block_10, v=code_block_10)
pointAtParameter_8 = Surface.PointAtParameter(surface=surfaceGeometry, u=code_block_10, v=code_block_10)

# group: Filter out Top and Bottom Surfaces (X component of normal == 0)
X_3 = Vector.X(vector=normalAtParameter)
code_block_11 = CodeBlock(x=X_3) { x==0; }
filterByBoolMask_7 = List.FilterByBoolMask(list=surfaceGeometry, mask=code_block_11)
filterByBoolMask_8 = List.FilterByBoolMask(list=normalAtParameter, mask=code_block_11)

filterByBoolMask_9 = List.FilterByBoolMask(list=pointAtParameter_8, mask=code_block_11)
code_block_12 = CodeBlock { 1; }
flatten_8 = List.Flatten(list=filterByBoolMask_9.out, amt=code_block_12)

# group (continued): Get Normal for each Face
byTwoPoints = Vector.ByTwoPoints(start=code_block_7.x, end=flatten_8, lacing=CrossProduct)

# group: Get Surfaces that are Facing the Viewpoint (ignores very acute angles of <10 degrees)
# note: Needs further refinement to avoid surface that are facing to viewer but obscured by other surfaces on the form
code_block_13 = CodeBlock(x=filterByBoolMask_7.out) { x; }
code_block_14 = CodeBlock(x=code_block_13) { [x]; }
count_2 = List.Count(list=byTwoPoints)
cycle = List.Cycle(list=code_block_14, amount=count_2)
angleWithVector = Vector.AngleWithVector(vector=filterByBoolMask_8.out, otherVector=byTwoPoints@L2)
# note: Use 100 degrees as the limit to avoid very acute angled surfaces to the viewpoiunt (<10 degrees)
minimum_angle = CodeBlock { 10; }
gt = angleWithVector > minimum_angle
filterByBoolMask_10 = List.FilterByBoolMask(list=cycle, mask=gt)

# note: Requires further work to ensure the number of panels are proportional to the area of the face
number_of_panel_divisions = CodeBlock { 4; }

# group: Lunchbox Panels
panelQuad = Geometry.Panel.PanelQuad(srf=filterByBoolMask_10.in, u=number_of_panel_divisions, v=number_of_panel_divisions)

# group: Get Revit Context Model
select_model_element_3 = DSModelElementSelection()  # 1 picked in the model
geometry = Element.Geometry(element=select_model_element_3)
explode = Geometry.Explode(geometry=geometry)
code_block_15 = CodeBlock { 2; }
flatten_9 = List.Flatten(list=explode, amt=code_block_15)

# group: Python Calculate Sightlines and Scores
python_script_8 = Python(IN[0]=code_block_7.x, IN[1]=panelQuad.Panels, IN[2]=flatten_9)
# ---------- python_script_8.python (71 lines) ----------
# Enable Python support and load DesignScript library
import clr
clr.AddReference('ProtoGeometry')
from Autodesk.DesignScript.Geometry import *

import math

# The inputs to this node will be stored as a list in the IN variables.
points = IN[0]
panels = IN[1]
buildings = IN[2]

lines = []
truncLines = []
truncLinesCol = []
dists = []
buildingsSort = []
keysSort = []
bools = []
scores = []
pansFail = []
pansPass = []

for p1, bPanels in zip(points, panels): # single viewpoint
	#dists.append([])
	dist = []
	bools.append([])
	for b in buildings: # loop through surfaces of buildings and get distance from viewpoint
		dist.append(Geometry.DistanceTo(p1, b))
	dists.append(dist)
	bSort = [x for _,x in sorted(zip(dist,buildings))] # sort by distance from viewpoint
	buildingsSort.append(bSort)
	#dists.append(dist)
	lines.append([])
	truncLines.append([])
	truncLinesCol.append([])
	score = 0
	panPass = 0
	panFail = 0
	for sPanels in bPanels: # side panels in viewpoint
		lines[-1].append([])
		truncLines[-1].append([])
		truncLinesCol[-1].append([])
		bools[-1].append([])
		for pan in sPanels: # for each panel
			p2 = Surface.PointAtParameter(pan, 0.5, 0.5)
			ln = Line.ByStartPointEndPoint(p1,p2)
			lines[-1][-1].append(ln)
			bool = False
			for b in bSort:
				if Geometry.DoesIntersect(b, ln):
					tp = Geometry.Intersect(b, ln)[0]
					truncLines[-1][-1].append(Line.ByStartPointEndPoint(p1,tp))
					truncLinesCol[-1][-1].append(0)
					bool = True
					break
			bools[-1][-1].append(bool)
			if bool:
				panPass += 1
			else:
				panFail += 1
				truncLines[-1][-1].append(ln)
				truncLinesCol[-1][-1].append(1)
	score = float(panPass) / (panPass + panFail) * 100
	scores.append(score)
	pansFail.append(panFail)
	pansPass.append(panPass)
					

# Assign your output to the OUT variable.
OUT = truncLines, bools, scores, pansFail, pansPass, truncLinesCol
# ----------------------------------------
code_block_16 = CodeBlock(x=python_script_8) { truncLines = x[0]; bools = x[1]; scores = x[2]; pansFail = x[3]; pansPass = x[4]; truncLinesCol = x[5]; }

# group: Mean Score for Form - High is Better
viewpoint_scores = Watch(code_block_16.scores)
mean_score = Math.Average(numbers=viewpoint_scores)
mean_score_2 = Watch(mean_score)  # graph output

# group: Coloured Spheres at Viewpoints
sphere_size = CodeBlock { 5; }
byCenterPointRadius = Sphere.ByCenterPointRadius(centerPoint=code_block_7.x, radius=sphere_size)
color_palette_5 = ColorPalette({R: 255, G: 69, B: 0, A: 255})
color_palette_6 = ColorPalette({R: 127, G: 255, B: 0, A: 255})
code_block_17 = CodeBlock(r=color_palette_5, g=color_palette_6) { [r,r,g]; }
code_block_18 = CodeBlock { [0,0.75,1]; }
code_block_19 = CodeBlock { 0; 100; 1; }
mapTo = Math.MapTo(rangeMin=code_block_19.out0, rangeMax=code_block_19.out1, inputValue=viewpoint_scores, targetRangeMin=code_block_19.out0, targetRangeMax=code_block_19.out2)
color_range = ColorRange(colors=code_block_17, indices=code_block_18, value=mapTo)
byGeometryColor_8 = Modifiers.GeometryColor.ByGeometryColor(geometry=byCenterPointRadius, color=color_range)

# group: Sightlines as Coloured Lines
code_block_20 = CodeBlock(g=color_palette_6, r=color_palette_5) { [g,r]; }
code_block_21 = CodeBlock(x=python_script_8) { x[5]; }
code_block_22 = CodeBlock(c=code_block_20, x=code_block_21) { c[x]; }
byGeometryColor_9 = Modifiers.GeometryColor.ByGeometryColor(geometry=code_block_16.truncLines, color=code_block_22)

# group: Volume - High is Better
volume_2 = Solid.Volume(solid=code_block_8)
volume_3 = Watch(volume_2)  # graph output
