# Dynamo graph 04_Solar Analysis.dyn (Dynamo 2.0.3.8810)

# group: Creates the Base Surface
code_block = CodeBlock { 100; }
byWidthLength = Rectangle.ByWidthLength(width=code_block, length=code_block)
byPatch = Surface.ByPatch(closedCurve=byWidthLength)

# group: Creates the Aligned Surface
amount = DoubleSlider(6, range=0..10 step 0.1)
ZAxis = Vector.ZAxis()
number = DoubleInput(10)
XAxis = Vector.XAxis()
tilt_angle = DoubleSlider(25.6, range=-90..90 step 0.1)  # graph input
rotate = Vector.Rotate(vector=ZAxis, axis=XAxis, degrees=tilt_angle)
number_2 = DoubleInput(3)
number_3 = DoubleInput(1)
number_4 = DoubleInput(10)

code_block_2 = CodeBlock(x=amount) { -50..50..#x; }

# group (continued): Creates the Aligned Surface
byCoordinates = Point.ByCoordinates(x=code_block_2, y=code_block_2, lacing=CrossProduct)
byStartPointDirectionLength = Line.ByStartPointDirectionLength(startPoint=byCoordinates, direction=ZAxis, length=number)
endPoint = Curve.EndPoint(curve=byStartPointDirectionLength)
byStartPointDirectionLength_2 = Line.ByStartPointDirectionLength(startPoint=endPoint, direction=rotate, length=number_2)
pointAtParameter = Curve.PointAtParameter(curve=byStartPointDirectionLength_2, param=number_3)
byOriginNormal = Plane.ByOriginNormal(origin=pointAtParameter, normal=rotate)
byWidthLength_2 = Rectangle.ByWidthLength(plane=byOriginNormal, width=number_4, length=number_4)
byPatch_2 = Surface.ByPatch(closedCurve=byWidthLength_2)

addItemToEnd = List.AddItemToEnd(item=byPatch, list=byPatch_2)
code_block_3 = CodeBlock { 3; }
flatten = List.Flatten(list=addItemToEnd, amt=code_block_3)
code_block_4 = CodeBlock()
# ---------- code_block_4.designscript (5 lines) ----------
cyan=Color.ByARGB(255,0,255,255);
orange=Color.ByARGB(255,255,255,0);
red=Color.ByARGB(255,255,0,0);
colors=[cyan,orange,red];
indices=[0,0.5,1];
# ----------------------------------------

# group: Gets Weather for Analysis
number_5 = DoubleInput(-16.9167)
number_6 = DoubleInput(145.767)
byLatitudeLongitude = DynamoSolarAnalysis.Weather.Weather.ByLatitudeLongitude(latitude=number_5, longitude=number_6)

date_time = DateTime("2019-07-07T10:01:00")
boolean = BoolSelector(false)
still = DynamoSolarAnalysis.Analysis.TimeStudy.Still(dateTime=date_time, usesDST=boolean)
number_slider = DoubleSlider(2, range=0..100 step 0.1)
analyze = DynamoSolarAnalysis.Analysis.SolarAnalysis.Analyze(weather=byLatitudeLongitude, analysisSurfaces=flatten, shadingSurfaces=flatten, timeStudy=still, spacing=number_slider)
flatten_2 = List.Flatten(list=analyze.Peak)
maximumItem = List.MaximumItem(list=flatten_2)
code_block_5 = CodeBlock(n=analyze.Peak, max=maximumItem) { n/max; }
color_range = ColorRange(colors=code_block_4.colors, indices=code_block_4.indices, value=code_block_5)
bySurfaceColors = Modifiers.GeometryColor.BySurfaceColors(surface=flatten, colors=color_range)
origin = Point.Origin()
current = SunSettings()  # "SunSettings.Current"
sunDirection = SunSettings.SunDirection(sunSettings=current)
code_block_6 = CodeBlock { 500; }
byStartPointDirectionLength_3 = Line.ByStartPointDirectionLength(startPoint=origin, direction=sunDirection, length=code_block_6)
startDateTime = SunSettings.StartDateTime(sunSettings=current)
analyze_2 = DynamoSolarAnalysis.Analysis.SolarAnalysis.Analyze(weather=byLatitudeLongitude, analysisSurfaces=byPatch_2, shadingSurfaces=byPatch_2, timeStudy=still, spacing=number_slider)
flatten_3 = List.Flatten(list=analyze_2.Peak)
sum = Math.Sum(values=flatten_3)
code_block_7 = CodeBlock { 3; }
flatten_4 = List.Flatten(list=byPatch_2, amt=code_block_7)
area = Surface.Area(surface=flatten_4)
sum_2 = Math.Sum(values=area)
div = sum / sum_2
average_intensity = Watch(div)  # graph output
siteLocation = SiteLocation()
byLocation = DynamoSolarAnalysis.Weather.Weather.ByLocation(location=siteLocation)
latitude = DynamoUnits.Location.Latitude(location=siteLocation)
remember = Data.Remember(latitude)
longitude = DynamoUnits.Location.Longitude(location=siteLocation)
remember_2 = Data.Remember(longitude)
