# Dynamo graph OpenOfficeLayout_BiLTNA2019.dyn "OpenOfficeLayout4" (Dynamo 2.1.0.7500)

# group: OPEN OFFICE DESK LAYOUT Refinery Graph Example Readme
# note: DESCRIPTION
# This definition generates open office desk layout test fits using defined arrays of desks in an open work configuration. Controls are exposed to control system dimensions and orientation. When used in combination with Refinery, this definition will help users explore layouts based on performance metrics.
# note: DYNAMO PROJECT
# OpenOfficeLayout.dyn
# note: VERSIONS
# Revit 2020
# Dynamo 2.1
# note: ASSOCIATED FILES
# OpenOfficeSpace.rvt
# note: AUTHORS / CREATION DATE
# Autodesk Refinery Team and the Proving Ground, January 2019
# note: REQUIRED DYNAMO PACKAGES
# None
# note: ADDITIONAL COMMENTS

# group: Input Room from Revit
# note: Select a Revit room object
select_model_element = DSModelElementSelection()  # 1 picked in the model

# group: Get and remember room geometry
solids = Element.Solids(element=select_model_element)
remember = Data.Remember(solids)

# group: Display open office geometry
# note: This part of the definition visualizes the overall room boundary conditions and extracts key geometry for the layout.
faces = Topology.Faces(topology=remember)
surfaceGeometry = Face.SurfaceGeometry(face=faces)
flatten = List.Flatten(list=surfaceGeometry)
number = DoubleInput(0.5)
pointAtParameter = Surface.PointAtParameter(surface=surfaceGeometry, u=number, v=number)
Z = Point.Z(point=pointAtParameter)
flatten_2 = List.Flatten(list=Z)
sortByKey = List.SortByKey(list=flatten, keys=flatten_2)
number_2 = DoubleInput(0)
getItemAtIndex = List.GetItemAtIndex(list=sortByKey.sorted_list, index=number_2)
perimeterCurves = Surface.PerimeterCurves(surface=getItemAtIndex)
number_3 = DoubleInput(255)
number_4 = DoubleInput(115)
byARGB = Color.ByARGB(a=number_3, r=number_3, b=number_4)
byGeometryColor = Modifiers.GeometryColor.ByGeometryColor(geometry=perimeterCurves, color=byARGB)
number_5 = DoubleInput(40)
number_6 = DoubleInput(255)
byARGB_2 = Color.ByARGB(a=number_5, r=number_6, g=number_6, b=number_6)
byGeometryColor_2 = Modifiers.GeometryColor.ByGeometryColor(geometry=remember, color=byARGB_2)

# group: Non-Variable Inputs
additional_circulation_spacing = DoubleSlider(2, range=0..6 step 0.1)  # "Additional Circulation Spacing (Ft)"
# note: These inputs can be changed to variable inputs by selecting "Is Input" on the right click menu.
desk_width_ft = DoubleSlider(3, range=3..6 step 0.1)
desk_length_ft = DoubleSlider(5, range=4..6 step 0.1)
user_clearance_length_ft = DoubleSlider(0, range=0..4 step 0.1)

# group: INPUT - Variable Parameters
postion_on_room_surface_u = DoubleSlider(0.5, range=0..1 step 0.1)  # graph input
position_on_room_surface_v = DoubleSlider(0, range=0..1 step 0.1)  # graph input
select_edge = DoubleSlider(5, range=0..9 step 1)  # graph input
rotate = DoubleSlider(45, range=-90..90 step 15)  # graph input
user_clearance_width_ft = DoubleSlider(4, range=2..6 step 0.5)  # graph input
end_offset_ft = DoubleSlider(4.25, range=3..6 step 0.25)  # graph input

# group: Define Desk System Datums
number_7 = DoubleInput(2)
div = additional_circulation_spacing / number_7
pointAtParameter_2 = Surface.PointAtParameter(surface=getItemAtIndex, u=postion_on_room_surface_u, v=position_on_room_surface_v)
getItemAtIndex_2 = List.GetItemAtIndex(list=perimeterCurves, index=select_edge)
number_8 = DoubleInput(0.5)
pointAtParameter_3 = Curve.PointAtParameter(curve=getItemAtIndex_2, param=number_8)
ZAxis = Vector.ZAxis()
rotate_2 = Geometry.Rotate(geometry=getItemAtIndex_2, origin=pointAtParameter_3, axis=ZAxis, degrees=rotate)
normalAtParameter = Curve.NormalAtParameter(curve=rotate_2, param=number_8)
byOriginNormal = Plane.ByOriginNormal(origin=pointAtParameter_2, normal=normalAtParameter)
number_9 = DoubleInput(50)
add = desk_width_ft + user_clearance_width_ft
mul = add * number_7
add_2 = mul + additional_circulation_spacing
mul_2 = number_9 * add_2
number_10 = DoubleInput(2)
div_2 = mul_2 / number_10
translate = Geometry.Translate(geometry=byOriginNormal, direction=normalAtParameter, distance=div_2)
sequence = Sequence(amount=number_9, step=add_2)
number_11 = DoubleInput(-1)
mul_3 = sequence * number_11
translate_2 = Geometry.Translate(geometry=translate, direction=normalAtParameter, distance=mul_3)

# group: Divide runs of desks into construction plane for hosting desks
intersect = Geometry.Intersect(geometry=getItemAtIndex, other=translate_2)
code_block = CodeBlock { false; }
clean = List.Clean(list=intersect, preserveIndices=code_block)
flatten_3 = List.Flatten(list=clean)
code_block_2 = CodeBlock { "Autodesk.DesignScript.Geometry.Line"; }
removeIfNot = List.RemoveIfNot(list=flatten_3, type=code_block_2)
length = Curve.Length(curve=removeIfNot)
sub = length - end_offset_ft
pointAtSegmentLength = Curve.PointAtSegmentLength(curve=removeIfNot, segmentLength=sub)
pointAtSegmentLength_2 = Curve.PointAtSegmentLength(curve=removeIfNot, segmentLength=end_offset_ft)
byStartPointEndPoint = Line.ByStartPointEndPoint(startPoint=pointAtSegmentLength, endPoint=pointAtSegmentLength_2)
flatten_4 = List.Flatten(list=byStartPointEndPoint)
length_2 = Curve.Length(curve=flatten_4)
mod = length_2 % desk_length_ft
sub_2 = length_2 - mod
add_3 = desk_length_ft + user_clearance_length_ft
div_3 = sub_2 / add_3
sequence_2 = Sequence(amount=div_3, step=add_3)
pointAtSegmentLength_3 = Curve.PointAtSegmentLength(curve=flatten_4, segmentLength=sequence_2)
byOriginNormal_2 = Plane.ByOriginNormal(origin=pointAtSegmentLength_3, normal=normalAtParameter)
XAxis = Plane.XAxis(plane=byOriginNormal_2)
normal = Plane.Normal(plane=byOriginNormal_2)
YAxis = Plane.YAxis(plane=byOriginNormal_2)

# group: Generate desk geometry and clearance bounding rectangles
byOriginXAxisYAxis = Plane.ByOriginXAxisYAxis(origin=pointAtSegmentLength_3, xAxis=normal, yAxis=YAxis)
number_12 = DoubleInput(-2)
div_4 = desk_length_ft / number_12
translate_3 = Geometry.Translate(geometry=byOriginXAxisYAxis, direction=YAxis, distance=div_4)
number_13 = DoubleInput(2)
div_5 = desk_width_ft / number_13
translate_4 = Geometry.Translate(geometry=translate_3, direction=normal, distance=div_5)
byWidthLength = Rectangle.ByWidthLength(plane=translate_4, width=desk_width_ft, length=desk_length_ft)
number_14 = DoubleInput(-1)
mul_4 = desk_width_ft * number_14
div_6 = mul_4 / number_13
translate_5 = Geometry.Translate(geometry=translate_3, direction=normal, distance=div_6)
byWidthLength_2 = Rectangle.ByWidthLength(plane=translate_5, width=desk_width_ft, length=desk_length_ft)
list_create = List.Create(item0=byWidthLength, item1=byWidthLength_2)
flatten_5 = List.Flatten(list=list_create)
add_4 = user_clearance_width_ft + desk_width_ft
number_15 = DoubleInput(2)
div_7 = add_4 / number_15
translate_6 = Geometry.Translate(geometry=translate_3, direction=normal, distance=div_7)
byWidthLength_3 = Rectangle.ByWidthLength(plane=translate_6, width=add_4, length=desk_length_ft)
number_16 = DoubleInput(-1)
mul_5 = add_4 * number_16
div_8 = mul_5 / number_15
translate_7 = Geometry.Translate(geometry=translate_3, direction=normal, distance=div_8)
byWidthLength_4 = Rectangle.ByWidthLength(plane=translate_7, width=add_4, length=desk_length_ft)
list_create_2 = List.Create(item0=byWidthLength_3, item1=byWidthLength_4)
flatten_6 = List.Flatten(list=list_create_2)

# group: Test desk geometry against room boundaries and and remove conflicts
code_block_3 = CodeBlock(RoomBoundary=perimeterCurves, DeskAndClearanceArea=flatten_6) { RoomBoundary; DeskAndClearanceArea; }
doesIntersect = Geometry.DoesIntersect(geometry=code_block_3.RoomBoundary, other=code_block_3.DeskAndClearanceArea@L1)
countTrue = List.CountTrue()  # unwired: list
map = List.Map(list=doesIntersect, f_x=countTrue)
number_17 = DoubleInput(0)
gt = map > number_17
filterByBoolMask = List.FilterByBoolMask(list=flatten_6, mask=gt)
list_create_3 = List.Create(item0=filterByBoolMask.out)
code_block_4 = CodeBlock(DeskList=list_create_3)
# ---------- code_block_4.designscript (3 lines) ----------
//Resulting Desks
//and ClearanceArea
DeskList;
# ----------------------------------------

# group (continued): Generate desk geometry and clearance bounding rectangles
filterByBoolMask_2 = List.FilterByBoolMask(list=flatten_5, mask=gt)

# group: OUTPUT - Layout Performance Metrics
code_block_5 = CodeBlock(desks=filterByBoolMask_2.out) { desks; }
count = List.Count(list=code_block_5)
number_of_desks = Watch(count)  # graph output
code_block_6 = CodeBlock(DeskLength=desk_length_ft) { DeskLength; }
code_block_7 = CodeBlock(UserClearanceLength=user_clearance_length_ft) { UserClearanceLength; }
add_5 = code_block_6 + code_block_7
code_block_8 = CodeBlock(UserClearanceWidth=user_clearance_width_ft) { UserClearanceWidth; }
add_6 = code_block_6 + code_block_8
mul_6 = add_5 * add_6
workspace_area_per_person = Watch(mul_6)
area = Surface.Area(surface=getItemAtIndex)
div_9 = area / count
total_area_per_person = Watch(div_9)  # graph output
# note: This part of the definition establishes several performance metrics that can be used in optimization. For example, maximizing desk count while minimizing left over area.
div_10 = workspace_area_per_person / total_area_per_person
area_utilization = Watch(div_10)  # graph output
code_block_9 = CodeBlock(desks=code_block_5) { desks; }

# group: INTEGRATE - Revit Output
family_types = FamilyTypes("BasicWorkDesk:BasicWorkDesk")
code_block_10 = CodeBlock(Planes=translate_4, Desks=translate_5, Mask=gt) { Planes; Desks; Mask; }  # frozen
list_create_4 = List.Create(item0=code_block_10.Planes, item1=code_block_10.Desks)
flatten_7 = List.Flatten(list=list_create_4)
filterByBoolMask_3 = List.FilterByBoolMask(list=flatten_7, mask=code_block_10.Mask)
origin = Plane.Origin(plane=filterByBoolMask_3.out)
byPoint = FamilyInstance.ByPoint(familyType=family_types, point=origin)
XAxis_2 = Vector.XAxis()
XAxis_3 = Plane.XAxis(plane=filterByBoolMask_3.out)
angleWithVector = Vector.AngleWithVector(vector=XAxis_2, otherVector=XAxis_3)
number_18 = DoubleInput(-1)
mul_7 = angleWithVector * number_18
number_19 = DoubleInput(90)
add_7 = mul_7 + number_19
setRotation = FamilyInstance.SetRotation(familyInstance=byPoint, degree=add_7)
string = StringInput("Length")
deskLength = Watch(desk_length_ft)
setParameterByName = Element.SetParameterByName(element=setRotation, parameterName=string, value=deskLength)
string_2 = StringInput("Width")
deskWidth = Watch(desk_width_ft)
setParameterByName_2 = Element.SetParameterByName(element=setParameterByName, parameterName=string_2, value=deskWidth)

# group: Private desks analysis
# note: First node gets the distance from each desk to every other desk.
code_block_11 = CodeBlock { 0.125; }
pointAtParameter_4 = Curve.PointAtParameter(curve=code_block_9, param=code_block_11)
distanceTo = Geometry.DistanceTo(geometry=pointAtParameter_4, other=pointAtParameter_4, lacing=CrossProduct)
# note: Second node asks “for any desk is the distance to another desk less then 12?” then returns 1 for true values, and 0 for false values, and sums the number of desks that are less than 12' for each desk.
code_block_12 = CodeBlock(a=distanceTo) { Math.Sum(a < 12? 1 : 0); }
# note: The third node asks “is the sum of any set of values (e.g. desks less than 12' away) less then 3?” and returns 1 if so (meaning it was classified as private), or 0 if not (meaning it wasn’t private), and sums the result.
# The watch node outputs the resulting count of how many private desks there are - how many desks have less than 3 desks that are within 12'.
# This calculates the number of desks which have a reasonable degree of spatial privacy based on having less then 3 other desks within 12 feet of them.’
# Both the 12 and 3 are somewhat arbitrary. I noticed I could hear my neighbors if they were at a desk less than 12' away, but I was oblivious to whoever was at a desk more than 12' away.
# It should be noted that privacy at work is relative. Someone who only cares about what shows on screen might be fine sitting within 12’ of 3 people, but someone who needs audio privacy might not be ok with being within 12’ of even 1 person.
code_block_13 = CodeBlock(a=code_block_12) { Math.Sum(a < 3 ? 1 : 0); }
private_desks = Watch([code_block_13, code_block_13, code_block_13])  # graph output

# group: Visualize Desks
color_palette = ColorPalette({R: 220, G: 220, B: 220, A: 255})
byGeometryColor_3 = Modifiers.GeometryColor.ByGeometryColor(geometry=list_create_3, color=color_palette)
byPatch = Surface.ByPatch(closedCurve=filterByBoolMask_2.out)
color_palette_2 = ColorPalette({R: 255, G: 20, B: 147, A: 255})
byGeometryColor_4 = Modifiers.GeometryColor.ByGeometryColor(geometry=byPatch, color=color_palette_2)
