# Dynamo graph tile optimizerBiLT.dyn "tile optimizer - v4" (Dynamo 2.1.0.7500)

# group: ReadMe
# note: GRAPH BUILT BY: Jacob Small of Autodesk Premium Support
# twitter: @JACOBWSMALL
# PACKAGES IN USE:
# 	Refinery  v.0.9.4
# 	Clockwork v.2.1.2
# SOFTWARE USED:
# 	Dynamo 2.1.0
# 	Revit 2020.0
# 	Refinery 0.9.4

# group: Inputs
select_face = DSFaceSelection()  # 1 picked in the model
remember = Data.Remember(select_face)
rotation = DoubleSlider(55, range=0..180 step 5)  # graph input
tileWidth = DoubleSlider(10, range=4..10 step 2)  # graph input
widthOffset = DoubleSlider(0.4, range=0.1..1 step 0.1)  # graph input
tile_length = DoubleSlider(8, range=6..12 step 0.5)  # graph input
lengthOffset = DoubleSlider(0.9, range=0.1..1 step 0.1)  # graph input

# group: set startpoint
pointAtParameter = Surface.PointAtParameter(surface=remember)

# group: Gets the surface's coordinate system and build the vector for the direction setup on the length and width edges.
coordinateSystemAtParameter = Surface.CoordinateSystemAtParameter(surface=remember)
XAxis = CoordinateSystem.XAxis(coordinateSystem=coordinateSystemAtParameter)
ZAxis = CoordinateSystem.ZAxis(coordinateSystem=coordinateSystemAtParameter)
rotate = Vector.Rotate(vector=XAxis, axis=ZAxis, degrees=rotation)
YAxis = CoordinateSystem.YAxis(coordinateSystem=coordinateSystemAtParameter)
rotate_2 = Vector.Rotate(vector=YAxis, axis=ZAxis, degrees=rotation)
list_create = List.Create(item0=rotate, item1=rotate_2)

# group: define max distance any joint could be
byGeometry = BoundingBox.ByGeometry(geom=remember)
maxPoint = BoundingBox.MaxPoint(boundingBox=byGeometry)
minPoint = BoundingBox.MinPoint(boundingBox=byGeometry)
distanceTo = Geometry.DistanceTo(geometry=maxPoint, other=minPoint)

# group: Move the startpoint by -1.25 * the value of the maximum length.
code_block = CodeBlock(a=distanceTo) { -1.25*a; }
translate = Geometry.Translate(geometry=pointAtParameter, direction=list_create, distance=code_block)

# group: Draw the initial lines for the tiles length and width edges.
code_block_2 = CodeBlock(a=distanceTo) { 2.5*a; }
byStartPointDirectionLength = Line.ByStartPointDirectionLength(startPoint=translate, direction=list_create, length=code_block_2)

# group: offset the initial lines by the tile dimensions * the respective offset factor
code_block_3 = CodeBlock(width=tileWidth, widthOffset=widthOffset, length=tile_length, lengthOffset=lengthOffset)
# ---------- code_block_3.designscript (4 lines) ----------
[
	width*widthOffset,
	length*lengthOffset
];
# ----------------------------------------
offset = Curve.Offset(curve=byStartPointDirectionLength, distance=code_block_3)

# group: Offset the tile start lines by a range from the negative maximum to the positive maximum, stepping by the respective dimensions (yes this shifts the initial long edge but we aren't looking for specifics we are looking for fast math - refinery will find the specifics for us)
code_block_4 = CodeBlock(a=distanceTo, width=tileWidth, length=tile_length)
# ---------- code_block_4.designscript (4 lines) ----------
[
	-a..a..width,
	-a..a..length
];
# ----------------------------------------
offset_2 = Curve.Offset(curve=offset, distance=code_block_4)

# group: Extrude the offset curves into a surface, and build them into a polysurface for the length edge and the width edge
extrude = Curve.Extrude(curve=offset_2, direction=ZAxis)
code_block_5 = CodeBlock(a=extrude) { a[0]; a[1]; }
byJoinedSurfaces = PolySurface.ByJoinedSurfaces(surfaces=code_block_5.out0)
byJoinedSurfaces_2 = PolySurface.ByJoinedSurfaces(surfaces=code_block_5.out1)

# group: Splits the main surface into subsurfaces by the length polysurface.
split = Geometry.Split(geometry=remember, other=byJoinedSurfaces)
flatten = List.Flatten(list=split)

# group: Splits the subsurfaces into tiles using the width polysurface.
split_2 = Geometry.Split(geometry=flatten, other=byJoinedSurfaces_2)

# group: flattens the list of tiles - we no longer need the offset values
flatten_2 = List.Flatten(list=split_2)

# group: gets the area of each tile
area = Surface.Area(surface=flatten_2)
code_block_6 = CodeBlock { 6; }
round = Math.Round(number=area, digits=code_block_6)

# group: gets the full tile area
code_block_7 = CodeBlock(width=tileWidth, length=tile_length) { width*length; }

# group: filters the list of tiles into full and partial tiles based on the area being equal to the area of the full tile
eq = round == code_block_7
filterByBoolMask = List.FilterByBoolMask(list=flatten_2, mask=eq)

# group: display the full tiles, tile edges, and partial tiles
perimeterCurves = Surface.PerimeterCurves(surface=flatten_2)
color_palette = ColorPalette({R: 72, G: 209, B: 204, A: 255})
byGeometryColor = Modifiers.GeometryColor.ByGeometryColor(geometry=filterByBoolMask.in@L1, color=color_palette)
color_palette_2 = ColorPalette({R: 255, G: 215, B: 0, A: 255})
byGeometryColor_2 = Modifiers.GeometryColor.ByGeometryColor(geometry=filterByBoolMask.out@L1, color=color_palette_2)

# group: Count the number of full tiles
count = List.Count(list=byGeometryColor)

# group: Count the number of partial tiles
count_2 = List.Count(list=byGeometryColor_2)

# group: Get the total area of the partial tiles.
area_2 = Surface.Area(surface=filterByBoolMask.out)
sum = Math.Sum(values=area_2)
code_block_8 = CodeBlock { 3; }
round_2 = Math.Round(number=sum, digits=code_block_8)

# group: Get the total discarded area of the partial tiles
code_block_9 = CodeBlock(max=code_block_7, actual=area_2) { max-actual; }
sum_2 = Math.Sum(values=code_block_9)
code_block_10 = CodeBlock { 3; }
round_3 = Math.Round(number=sum_2, digits=code_block_10)

# group: Outputs
full_tile_count = Watch(count)  # graph output
partial_tile_count = Watch(count_2)  # graph output
partial_tile_area = Watch(round_2)  # graph output
# note: How much material will go to the landfill?
discarded_area = Watch(round_3)  # graph output

# group: Integrate into Revit?
boolean = BoolSelector(false)

# group: Allows the 'move to revit' boolean to filter out all geometry to keep Refinery from putting calculation efforts into stuff that's only needed when moving stuff into Revit.
# note: Clockwork v2.1.2
fromDynamoSurface = Custom[Element.FromDynamoSurface](DynamoSurface=select_face)  # Returns the underlying Revit element of a given face
filterByBoolMask_2 = List.FilterByBoolMask(list=fromDynamoSurface, mask=boolean)
code_block_11 = CodeBlock(a=offset_2) { [a]; }
filterByBoolMask_3 = List.FilterByBoolMask(list=code_block_11, mask=boolean)
filterByBoolMask_4 = List.FilterByBoolMask(list=remember, mask=boolean)

# group: Gets the single element out of the list created by previous nodes.
firstItem = List.FirstItem(list=filterByBoolMask_2.in)
firstItem_2 = List.FirstItem(list=filterByBoolMask_4.in)

# group: Create straight lines from the tile line curves
flatten_3 = List.Flatten(list=filterByBoolMask_3.in)
code_block_12 = CodeBlock { 0..1; }
pointAtParameter_2 = Curve.PointAtParameter(curve=flatten_3@L1, param=code_block_12)
byBestFitThroughPoints = Line.ByBestFitThroughPoints(bestFitPoints=pointAtParameter_2)

# group: Create a sketch plane (a revit element) on the face of the originally selected surface.
code_block_13 = CodeBlock { [0,0.5,1]; [0.5,0,1]; }
pointAtParameter_3 = Surface.PointAtParameter(surface=firstItem_2, u=code_block_13.out0, v=code_block_13.out1)
code_block_14 = CodeBlock(a=pointAtParameter_3) { a[0]; a[1]; a[2]; }
byThreePoints = Plane.ByThreePoints(origin=code_block_14.out0, planePoint=code_block_14.out1, xAxisPoint=code_block_14.out2)
byPlane = SketchPlane.ByPlane(plane=byThreePoints)

# group: Part creation code by Einar Raknes.
# note: https://forum.dynamobim.com/t/dividing-parts-with-dynamo/5388/5?u=jacobsmall
python_script = Python(IN[0]=firstItem, IN[1]=byBestFitThroughPoints, IN[2]=byPlane)
# ---------- python_script.python (47 lines) ----------
#Part creation script by Einar Raknes. 
#Source: https://forum.dynamobim.com/t/dividing-parts-with-dynamo/5388/5?u=jacobsmall

import clr

clr.AddReference('RevitAPI')
from Autodesk.Revit.DB import *

clr.AddReference('System')
from System.Collections.Generic import List

clr.AddReference('RevitNodes')
import Revit
clr.ImportExtensions(Revit.GeometryConversion)
clr.ImportExtensions(Revit.Elements)

clr.AddReference('RevitServices')
import RevitServices
from RevitServices.Persistence import DocumentManager
from RevitServices.Transactions import TransactionManager

doc = DocumentManager.Instance.CurrentDBDocument

#Preparing input from dynamo to revit
wall = UnwrapElement(IN[0])
divisionLines = [l.ToRevitType(True) for l in IN[1]]
sketchPlane = UnwrapElement(IN[2])

#Create a list for the wall and the divisionLines
wallList = List[ElementId]()
wallList.Add(wall.Id)
intersectionElementsIds = List[ElementId]()
curveArray = List[Curve](divisionLines)

#All actions that makes changes to the Revit database needs to be inside a Transaction
TransactionManager.Instance.EnsureInTransaction(doc)

if PartUtils.AreElementsValidForCreateParts(doc, wallList):
	createParts = PartUtils.CreateParts(doc, wallList)
	doc.Regenerate()

parts = PartUtils.GetAssociatedParts(doc, wall.Id, 0, 0)
partDivide = PartUtils.DivideParts(doc, parts, intersectionElementsIds, curveArray, sketchPlane.Id)

TransactionManager.Instance.TransactionTaskDone()

OUT = partDivide
# ----------------------------------------
