# Dynamo graph 01-Bnh.dyn "01-bnh" (Dynamo 2.0.2.6826)

# note: Checking / Outputs
# Red indicates checking nodes to ensure the script has deployed correctly.

# group: BnH Refinery Graph Example
# note: DYNAMO PROJECT
# 01-bnh.dyn
# note: ASSOCIATED FILE(S)
# N/A
# note: AUTHOR(S) / CREATION DATE
# Refinery Team and The Proving Ground / Dec 2018
# note: DESCRIPTION
# The bnh graph refers to the Bihn and Korn function that seeks to optomise the results of multi-objective algorithm. In this case we want to either maximise or minimise our numeric outputs.
# This graph is used to showcase how Refinery works with a Pareto curve output when executed.
# note: DYNAMO VERSION
# 2.0.2
# note: ADDITIONAL COMMENTS
# N/A
# note: REQUIRED DYNAMO PACKAGES
# N/A

# group: Input: Changable variables
# note: Variables / Inputs
# Green indicates Variables that can be altered per project and must be set accordingly before running the script.
# note: NOTE:
# In order to see an 'Input' in Refinery, you have to right-click on a compatible node and check the 'Is Input' option. Rename the node to see a legible input name in Refinery.
input_1 = DoubleSlider(1, range=0..5 step 0.01)  # graph input
# note: Working / Functions
# Orange indicates the working of the script. No changes should be made in these groups unless advised.
input_2 = DoubleSlider(2, range=0..3 step 0.01)  # graph input

# group: Data: Calculations
code_block = CodeBlock(x=input_1, y=input_2) { (4 * x * x) + (4 * y * y); ((x - 5) * (x - 5)) + ((y - 5) * (y - 5)); }

# group: Output Output information that can be used to filter results in Refinery
# note: NOTE:
# In order to see an 'Output' in Refinery, you have to right-click on a compatible node and check the 'Is
# Output' option. Rename the node to see a legible output name in Refinery.
output_01 = Watch(code_block.out0)  # graph output
output_02 = Watch(code_block.out1)  # graph output
