# Dynamo graph 02-3BoxVolumeSurfaceArea.dyn (Dynamo 2.0.2.6826)

# group: 3BOX VOLUME SURFACE AREA Refinery Graph Example
# note: DYNAMO PROJECT
# 02-3BoxVolumeSurfaceArea.dyn
# note: ASSOCIATED FILE(S)
# N/A
# note: AUTHOR(S) / CREATION DATE
# Refinery Team and The Proving Ground / Dec 2018
# note: DESCRIPTION
# This graph contains three Cuboids representing buildings. Cuboid One (C1) has a fixed location, but varies in Height. Cuboid Two (C2) and Cuboid Three (C3) can both vary in Location (Both X and Y directions) as well as Height.
# The graph uses Refinery to find the minimum Volume that correlates with the maximum Surface Area.
# note: DYNAMO VERSION
# 2.0.2
# note: ADDITIONAL COMMENTS
# N/A
# note: REQUIRED DYNAMO PACKAGES
# N/A

# group: Input: Changable variables
# note: Variables / Inputs
# Green indicates Variables that can be altered per project and must be set accordingly before running the script.
# note: NOTE:
# In order to see an 'Input' in Refinery, you have to right-click on a compatible node and check the 'Is Input' option. Rename the node to see a legible input name in Refinery.
c1_height = DoubleSlider(154.7076328, range=19.70763281..200 step 1)  # graph input
# note: Working / Functions
# Orange indicates the working of the script. No changes should be made in these groups unless advised.
c2_x_location = DoubleSlider(40, range=0..50 step 1)  # graph input
c2_y_location = DoubleSlider(31, range=0..50 step 1)  # graph input
# note: Checking / Outputs
# Red indicates checking nodes to ensure the script has deployed correctly.
c2_height = DoubleSlider(79, range=20..200 step 1)  # graph input
c3_x_location = DoubleSlider(59.10650294, range=20.10650294..70 step 1)  # graph input
c3_y_location = DoubleSlider(53.48223563, range=20.48223563..70 step 1)  # graph input
c3_height = DoubleSlider(62, range=20..200 step 1)  # graph input

# group: Geometry [Dynamo]: Geometry Manipulation
byCoordinates = Point.ByCoordinates()
width = CodeBlock { 50; }
byLengths = Cuboid.ByLengths(origin=byCoordinates, width=width, length=width, height=c1_height)
code_block = CodeBlock(h=c1_height) { h/2; }
translate = Geometry.Translate(geometry=byLengths, zTranslation=code_block)
byCoordinates_2 = Point.ByCoordinates(x=c2_x_location, y=c2_y_location)
byLengths_2 = Cuboid.ByLengths(origin=byCoordinates_2, width=width, length=width, height=c2_height)
code_block_2 = CodeBlock(h=c2_height) { h/2; }
translate_2 = Geometry.Translate(geometry=byLengths_2, zTranslation=code_block_2)
union = Solid.Union(solid=translate, solid_2=translate_2)
byCoordinates_3 = Point.ByCoordinates(x=c3_x_location, y=c3_y_location)
byLengths_3 = Cuboid.ByLengths(origin=byCoordinates_3, width=width, length=width, height=c3_height)
code_block_3 = CodeBlock(h=c3_height) { h/2; }
translate_3 = Geometry.Translate(geometry=byLengths_3, zTranslation=code_block_3)
union_2 = Solid.Union(solid=union, solid_2=translate_3)
explode = Geometry.Explode(geometry=union_2)

# group: Analysis: Surface Area and Volume
area = Surface.Area(surface=explode)
sum = Math.Sum(values=area)
volume = Solid.Volume(solid=union_2)

# group: Output: Output information that can be used to filter results in Refinery
# note: NOTE:
# In order to see an 'Output' in Refinery, you have to right-click on a compatible node and check the 'Is
# Output' option. Rename the node to see a legible output name in Refinery.
totalsurfacearea_max = Watch(sum)  # graph output
totalvolume_min = Watch(volume)  # graph output

# group: Visualization: Colourizes Dynamo geometry in the Background Preview window
color_palette = ColorPalette({R: 5, G: 195, B: 222, A: 255})
byGeometryColor = Modifiers.GeometryColor.ByGeometryColor(geometry=union_2, color=color_palette)
