# Dynamo graph 11-WindowHeightFloorDepth.dyn (Dynamo 2.0.2.6660)

# group: WINDOW HEIGHT / FLOOR DEPTH Refinery Graph Example
# note: DYNAMO PROJECT
# REFINERY_WINDOW_HEIGHT_FLOOR_DEPTH
# note: ASSOCIATED FILE(S)
# N/A
# note: AUTHOR(S) / CREATION DATE
# Refinery Team and The Proving Ground / Dec 2018
# note: DESCRIPTION
# This example is based on the architectural daylighting rule of thumb that says to maximize the amount of light in a room, the depth of the room should be 2.5x the height of the window. In this scenario, the length of the window increases as the length of the room increases, and the depth of the room increases as the window height increases. This solver aims to maximize window area but minimize depth of the room.
# This can be a quick tool to gauge how large a room and window can be while maintaining the most natural light.
# note: DYNAMO VERSION
# 2.0.2
# note: ADDITIONAL COMMENTS
# N/A
# note: REQUIRED DYNAMO PACKAGES
# N/A

# group: Input: Changeable variables
# note: Variables / Inputs
# Red indicates Variables that can be altered per project and must be set accordingly before running the script.
# note: Working / Functions
# Green indicates the working of the script. No changes should be made in these groups unless advised.
# note: NOTE:
# In order to see an 'Input' in Refinery, you have to right-click on a compatible node and check the 'Is Input' option. Rename the node to see a legible input name in Refinery.
window_height = DoubleSlider(7.5, range=0..12 step 0.1)  # graph input
# note: Checking / Outputs
# Orange indicates checking nodes to ensure the script has deployed correctly.
window_width = IntegerSlider(65, range=20..100 step 1)  # graph input

# group: Geometry [Dynamo]: Create Dynamo solid depiction of room
code_block = CodeBlock { 2.5; }
seal_height = CodeBlock { 2; }
window_height_actual = window_height + seal_height
mul = code_block * window_height_actual
byWidthLength = Rectangle.ByWidthLength(width=mul, length=window_width)
room_height = CodeBlock { 15; }
extrudeAsSolid = Curve.ExtrudeAsSolid(curve=byWidthLength, distance=room_height)
window_height_from_floor = Watch(window_height_actual)

# group: Window Parameters
faces = Topology.Faces(topology=extrudeAsSolid)
surfaceGeometry = Face.SurfaceGeometry(face=faces)
perimeterCurves = Surface.PerimeterCurves(surface=surfaceGeometry)
# note: DesignScript is used to pull the base surfaces perimeter curves:
# 'zValues' will generate a point at the center of each curve in our list of lists then query the Z value of each point.
# 'mask' will generate a mask by querying if the Z value equals zero for each point using the List@Level syntax and then Count the amount of True values and only return a single True/False value for the master-list (Tier one) of 'True' if all Point Z-values equat to zero.
# 'filter' will use FilterByBoolMask to filter using our mask and we return only the correlating 'True' values by appending the 'in' dictionary key.
code_block_2 = CodeBlock(crvs=perimeterCurves)
# ---------- code_block_2.designscript (3 lines) ----------
zValues = Autodesk.DesignScript.Curve.PointAtParameter(crvs, 0.5).Z;
mask = DSCore.List.CountTrue((zValues == 0)@L2<1>) == 4;
filter = DSCore.List.Flatten(DSCore.List.FilterByBoolMask(crvs, mask)["in"], 1);
# ----------------------------------------
number_slider = DoubleSlider(2, range=2..2 step 1)
# note: Choose which side to create our 'Window' on
getItemAtIndex = List.GetItemAtIndex(list=code_block_2.filter, index=number_slider)
code_block_3 = CodeBlock { 0.5; }
mul_2 = window_width * code_block_3
coordinateSystemAtSegmentLength = Curve.CoordinateSystemAtSegmentLength(curve=getItemAtIndex, segmentLength=mul_2)
byCartesianCoordinates = Point.ByCartesianCoordinates(cs=coordinateSystemAtSegmentLength)

# group: Creating the Window Geometry
code_block_4 = CodeBlock(SealHeight=seal_height, Height=window_height) { SealHeight + Height/2; }
translate = Geometry.Translate(geometry=byCartesianCoordinates, zTranslation=code_block_4)
XAxis = CoordinateSystem.XAxis(coordinateSystem=coordinateSystemAtSegmentLength)
byOriginNormal = Plane.ByOriginNormal(origin=translate, normal=XAxis)
code_block_5 = CodeBlock(Width=window_width) { Width*2/3; }
byWidthLength_2 = Rectangle.ByWidthLength(plane=byOriginNormal, width=window_height, length=code_block_5)
XAxis_2 = CoordinateSystem.XAxis(coordinateSystem=coordinateSystemAtSegmentLength)
reverse = Vector.Reverse(vector=XAxis_2)
extrudeAsSolid_2 = Curve.ExtrudeAsSolid(curve=byWidthLength_2, direction=reverse, distance=seal_height)
area = Solid.Area(solid=extrudeAsSolid_2)

# group: Outputs: Output information that can be used to filter results in Refinery
# note: NOTE:
# In order to see an 'Output' in Refinery, you have to right-click on a compatible node and check the 'Is
# Output' option. Rename the node to see a legible output name in Refinery.
room_depth = Watch(mul)  # graph output
window_area = Watch(area)  # graph output

# group: Visualization: Colourizes Dynamo geometry in the Background Preview window
byJoinedSurfaces = PolySurface.ByJoinedSurfaces(surfaces=surfaceGeometry)
byJoinedSurfaces_2 = Solid.ByJoinedSurfaces(facesOfSolid=byJoinedSurfaces)
differenceAll = Solid.DifferenceAll(solid=byJoinedSurfaces_2, others=extrudeAsSolid_2)
color_palette = ColorPalette({R: 5, G: 195, B: 222, A: 255})
byGeometryColor = Modifiers.GeometryColor.ByGeometryColor(geometry=differenceAll, color=color_palette)
color_palette_2 = ColorPalette({R: 255, G: 138, B: 61, A: 255})
byGeometryColor_2 = Modifiers.GeometryColor.ByGeometryColor(geometry=extrudeAsSolid_2, color=color_palette_2)
