# Dynamo graph 15-AmphitheatreTradeoffs.dyn (Dynamo 2.0.2.6660)

# group: AMPITHEATRE TRADEOFFS Refinery Graph Example
# note: DYNAMO PROJECT
# 15-AmpitheatreTradeoffs.dyn
# note: ASSOCIATED FILE(S)
# N/A
# note: AUTHOR(S) / CREATION DATE
# Refinery Team and The Proving Ground / Dec 2018
# note: DYNAMO VERSION
# 2.0.2
# note: ADDITIONAL COMMENTS
# N/A
# note: REQUIRED DYNAMO PACKAGES
# Lunchbox for Dynamo - v2018.7.6
# Note:
# The Lunchbox installation instructions are now the txt file in the Extra folder. To install Lunchbox you have to use an external installer in liue of the Package Manager.
# note: DESCRIPTION
# Adjust total width, curvature, and aisle interval at bottom row (subsequent rows offset out). Adjust row count and steepness incline. Maximize number of seats. Minimize average distance to focal point and ratio of obstructed to unobstructed views (clash with heads in front of viewer).
# This can be a great tool for stadium design in order to optimize seating for both seat density and viewer sight range.

# group: Inputs: Changeable variables
# note: Variables / Inputs
# Red indicates Variables that can be altered per project and must be set accordingly before running the script.
# note: NOTE:
# In order to see an 'Input' in Refinery, you have to right-click on a compatible node and check the 'Is Input' option. Rename the node to see a legible input name in Refinery.
bottom_row_end = DoubleSlider(11.13389906, range=10..50 step 0.1)  # graph input
# note: Working / Functions
# Green indicates the working of the script. No changes should be made in these groups unless advised.
curvature = DoubleSlider(0.3740429014, range=0.1..0.6802978541 step 0.1)  # graph input
bottom_row_length_between_aisles = IntegerSlider(20, range=20..24 step 1)  # graph input
# note: Checking / Outputs
# Orange indicates checking nodes to ensure the script has deployed correctly.
number_of_rows = IntegerSlider(6, range=6..30 step 1)  # graph input
incline = DoubleSlider(0.278157876, range=0.25..0.55 step 0.1)  # graph input

# group: Geometry [Dynamo]: Front Row Line
code_block = CodeBlock(x=bottom_row_end, c=curvature) { y=x*0.2; (c*x)+y; 2; -x; }
byCoordinates = Point.ByCoordinates(x=bottom_row_end, y=code_block.y, z=code_block.out2)
byCoordinates_2 = Point.ByCoordinates(y=code_block.out1, z=code_block.out2)
byCoordinates_3 = Point.ByCoordinates(x=code_block.out3, y=code_block.y, z=code_block.out2)
byThreePoints = Arc.ByThreePoints(firstPoint=byCoordinates, secondPoint=byCoordinates_2, thirdPoint=byCoordinates_3)

# group: Data: Aisle Removal Domains
code_block_2 = CodeBlock { 0; 1; }
length = Curve.Length(curve=byThreePoints)
code_block_3 = CodeBlock { [1,2]; }
mul = bottom_row_length_between_aisles * code_block_3
ge = bottom_row_end >= mul
countTrue = List.CountTrue(list=ge)
code_block_4 = CodeBlock(x=countTrue) { y=(x*2)+2; z=[0..y]; }
div = length / code_block_4.y
mul_2 = div * code_block_4.z
flatten = List.Flatten(list=mul_2)
count = List.Count(list=flatten)
code_block_5 = CodeBlock(x=count) { x-1; x-2; }
removeItemAtIndex = List.RemoveItemAtIndex(list=flatten, indices=code_block_5.out0)
code_block_6 = CodeBlock(x=removeItemAtIndex) { x+2; }
restOfItems = List.RestOfItems(list=flatten)
code_block_7 = CodeBlock(x=restOfItems) { x-2; }
list_create = List.Create(item0=code_block_6, item1=code_block_7)
transpose = List.Transpose(lists=list_create)
flatten_2 = List.Flatten(list=transpose)
mapTo = Math.MapTo(rangeMin=code_block_2.out0, rangeMax=length, inputValue=flatten_2, targetRangeMin=code_block_2.out0, targetRangeMax=code_block_2.out1)

# group: Geometry [Dynamo]: Bot Row Front Edge Lines
splitByParameter = Curve.SplitByParameter(curve=byThreePoints, parameters=mapTo)
code_block_8 = CodeBlock { 2; }
takeEveryNthItem = List.TakeEveryNthItem(list=splitByParameter, n=code_block_8)
count_2 = List.Count(list=takeEveryNthItem)

# group: Data: Rows Array
code_block_9 = CodeBlock(x=number_of_rows) { y=[0..x]; 3*y; }
offset = Curve.Offset(curve=takeEveryNthItem, distance=code_block_9.out1, lacing=CrossProduct)
code_block_10 = CodeBlock { 1; }
flatten_3 = List.Flatten(list=offset, amt=code_block_10)
transpose_2 = List.Transpose(lists=flatten_3)
flatten_4 = List.Flatten(list=transpose_2)
count_3 = List.Count(list=flatten_4)
code_block_11 = CodeBlock(x=incline, c=count_3) { y=x*3; a=[0..c]; b=y*a; -y; }

ZAxis = Vector.ZAxis()

# group: Geometry [Dynamo]: Risers Polysurface and Front Row Edge Lines
translate = Geometry.Translate(geometry=transpose_2, direction=ZAxis, distance=code_block_11.b@L2)
flatten_5 = List.Flatten(list=translate)
translate_2 = Geometry.Translate(geometry=translate, direction=ZAxis, distance=code_block_11.out3)
flatten_6 = List.Flatten(list=translate_2)
list_create_2 = List.Create(item0=flatten_5, item1=flatten_6)
transpose_3 = List.Transpose(lists=list_create_2)
byLoft = Surface.ByLoft(crossSections=transpose_3)
code_block_12 = CodeBlock(x=count_2) { x; -x; }
dropItems = List.DropItems(list=flatten_6, amount=code_block_12.x)
dropItems_2 = List.DropItems(list=flatten_5, amount=code_block_12.out1)
list_create_3 = List.Create(item0=dropItems, item1=dropItems_2)
transpose_4 = List.Transpose(lists=list_create_3)
byLoft_2 = Surface.ByLoft(crossSections=transpose_4)
list_create_4 = List.Create(item0=byLoft, item1=byLoft_2)

# group: Data: Seat Eye Level Point
code_block_13 = CodeBlock { 1; }
flatten_7 = List.Flatten(list=translate, amt=code_block_13)
code_block_14 = CodeBlock(x=code_block_11.y) { -1; x/2; 2.5; }
dropItems_3 = List.DropItems(list=flatten_7, amount=code_block_14.out0)
offset_2 = Curve.Offset(curve=dropItems_3, distance=code_block_14.out1)
translate_3 = Geometry.Translate(geometry=offset_2, direction=ZAxis, distance=code_block_14.out2)
transpose_5 = List.Transpose(lists=translate_3)
code_block_15 = CodeBlock(x=count_2) { [0..((x/2)-1)]; }
getItemAtIndex = List.GetItemAtIndex(list=transpose_5, index=code_block_15)
reverse = Curve.Reverse(curve=getItemAtIndex)
removeItemAtIndex_2 = List.RemoveItemAtIndex(list=transpose_5, indices=code_block_15)
list_create_5 = List.Create(item0=reverse, item1=removeItemAtIndex_2)
flatten_8 = List.Flatten(list=list_create_5)
code_block_16 = CodeBlock { 2; }
divideCurve = Geometry.Curves.DivideCurve(curve=flatten_8, Number=code_block_16)
flatten_9 = List.Flatten(list=divideCurve.Points)
transpose_6 = List.Transpose(lists=divideCurve.Points)

# group: Number of Seats
length_2 = Curve.Length(curve=flatten_8)
code_block_17 = CodeBlock(a=length_2) { Math.Round(a/1.6667); }
sum = Math.Sum(values=code_block_17)

# group: Focal Point
code_block_18 = CodeBlock { 5; }
byCoordinates_4 = Point.ByCoordinates(z=code_block_18)

# group: Data: Distance Categories
byTwoPoints = Vector.ByTwoPoints(start=byCoordinates_4, end=flatten_9, lacing=Longest)
length_3 = Vector.Length(vector=byTwoPoints)
sortIndexByValue = List.SortIndexByValue(list=length_3)
getItemAtIndex_2 = List.GetItemAtIndex(list=flatten_9, index=sortIndexByValue)
code_block_19 = CodeBlock { 300; }
chop = List.Chop(list=getItemAtIndex_2, lengths=code_block_19)
flatten_10 = List.Flatten(list=chop)
count_4 = List.Count(list=getItemAtIndex_2)
code_block_20 = CodeBlock(x=count_4) { x/300; }
ceiling = Math.Ceiling(number=code_block_20)
code_block_21 = CodeBlock(x=ceiling) { 0; 1; [1..x]; x+1; }
mapTo_2 = Math.MapTo(rangeMin=code_block_21.out0, rangeMax=code_block_21.out3, inputValue=code_block_21.out2, targetRangeMin=code_block_21.out0, targetRangeMax=code_block_21.out1)
flatten_11 = List.Flatten(list=mapTo_2)
transpose_7 = List.Transpose(lists=code_block_21.out2)
code_block_22 = CodeBlock(x=code_block_19, y=ceiling, z=count_4) { List.Flatten(([x..(x*(y-1)),(z-(x*(y-1)))]),1); }
ofRepeatedItem = List.OfRepeatedItem(item=transpose_7, amount=code_block_22, lacing=Shortest)
code_block_23 = CodeBlock { 2; }
flatten_12 = List.Flatten(list=ofRepeatedItem, amt=code_block_23)
mapTo_3 = Math.MapTo(rangeMin=code_block_21.out0, rangeMax=code_block_21.out3, inputValue=flatten_12, targetRangeMin=code_block_21.out0, targetRangeMax=code_block_21.out1)
flatten_13 = List.Flatten(list=mapTo_3)
average = Math.Average(numbers=length_3)

# group: Visualization: Seats Viz by Distance Category, Focal Point and Risers
code_block_24 = CodeBlock { 200; 119; 136; 153; }
byARGB = Color.ByARGB(a=code_block_24.out0, r=code_block_24.out1, g=code_block_24.out2, b=code_block_24.out3)
byGeometryColor = Modifiers.GeometryColor.ByGeometryColor(geometry=list_create_4, color=byARGB)
code_block_25 = CodeBlock { 255; 76; }
byARGB_2 = Color.ByARGB(a=code_block_25.out0, r=code_block_25.out1, g=code_block_25.out1, b=code_block_25.out1)
byGeometryColor_2 = Modifiers.GeometryColor.ByGeometryColor(geometry=byCoordinates_4, color=byARGB_2)
code_block_26 = CodeBlock { [0,24,88,167,231,255,255,255,255,255]; [128,140,172,211,243,255,231,167,88,24]; [0,0,0,0,0,0,0,0,0,0]; }
byARGB_3 = Color.ByARGB(r=code_block_26.out0, g=code_block_26.out1, b=code_block_26.out2)
color_range = ColorRange(colors=byARGB_3, indices=flatten_11, value=flatten_13)
byGeometryColor_3 = Modifiers.GeometryColor.ByGeometryColor(geometry=flatten_10, color=color_range)

# group: Geometry [Dynamo]: View Lines
byStartPointEndPoint = Line.ByStartPointEndPoint(startPoint=byCoordinates_4, endPoint=flatten_9)
getItemAtIndex_3 = List.GetItemAtIndex(list=byStartPointEndPoint, index=sortIndexByValue)
code_block_27 = CodeBlock { 30; }
gt = length_3 > code_block_27
countFalse = List.CountFalse(list=gt)
countTrue_2 = List.CountTrue(list=gt)
list_create_6 = List.Create(item0=countFalse, item1=countTrue_2)
chop_2 = List.Chop(list=getItemAtIndex_3, lengths=list_create_6)
code_block_28 = CodeBlock { [0.3,0.9]; [0.3,0.98]; 1; }
list_create_7 = List.Create(item0=code_block_28.out0, item1=code_block_28.out1)
splitByParameter_2 = Curve.SplitByParameter(curve=chop_2, parameters=list_create_7, lacing=Shortest)
code_block_29 = CodeBlock { 1; }
flatten_14 = List.Flatten(list=splitByParameter_2, amt=code_block_29)
transpose_8 = List.Transpose(lists=flatten_14)
getItemAtIndex_4 = List.GetItemAtIndex(list=transpose_8, index=code_block_28.out2)

# group: Geometry [Dynamo]: Obstructions
clean = List.Clean(list=transpose_6)
transpose_9 = List.Transpose(lists=clean)
code_block_30 = CodeBlock(x=count_2, y=number_of_rows) { z=[1..x]; a=y*z; b=a-1; }
removeItemAtIndex_3 = List.RemoveItemAtIndex(list=transpose_9, indices=code_block_30.b)

# group: Data: Test for point proximity to lines
removeNulls = Lists.Manage.RemoveNulls(Data=removeItemAtIndex_3)
flatten_15 = List.Flatten(list=removeNulls.Cleaned)
python_script = Python(IN[0]=getItemAtIndex_4, IN[1]=flatten_15)
# ---------- python_script.python (20 lines) ----------
# Enable Python support and load DesignScript library
import clr
clr.AddReference('ProtoGeometry')
from Autodesk.DesignScript.Geometry import *

# The inputs to this node will be stored as a list in the IN variables.
dataEnteringNode = IN

# Place your code below this line

x = 0

for l in IN[0]:
	for p in IN[1]:
		if l.DistanceTo(p) < 1:
			x = x + 1
			break

# Assign your output to the OUT variable.
OUT = x
# ----------------------------------------

# group: Data: Ratio
count_5 = List.Count(list=getItemAtIndex_4)
div_2 = python_script / count_5

# group: Outputs
# note: NOTE:
# In order to see an 'Output' in Refinery, you have to right-click on a compatible node and check the 'Is
# Output' option. Rename the node to see a legible output name in Refinery.
number_of_seats = Watch(sum)  # graph output
average_distance_to_focal_point = Watch(average)  # graph output
obstructed_views_ratio = Watch(div_2)  # graph output
