# Dynamo graph 17-MLSurfaceTest.dyn (Dynamo 2.0.2.6660)

# group: MACHINE LEARNING: SURFACE TEST Refinery Graph Example
# note: DYNAMO VERSION
# 2.0.2
# note: ADDITIONAL COMMENTS
# N/A
# note: REQUIRED DYNAMO PACKAGES
# Lunchbox for Dynamo - v2018.7.6
# Note:
# The Lunchbox installation instructions are now the txt file in the Extra folder. To install Lunchbox you have to use an external installer in liue of the Package Manager.
# note: DYNAMO PROJECT
# 17-MLSurfaceTest.dyn
# note: ASSOCIATED FILE(S)
# N/A
# note: AUTHOR(S) / CREATION DATE
# Refinery Team and The Proving Ground / Dec 2018
# note: DESCRIPTION
# Optimize surface panels using machine learning; outcomes are based on average planarity, average panel area, and average distance from original points.
# This is a great starting point for panel optimization using LunchBoxML machine learning tools.

# group: Inputs
# note: NOTE:
# In order to see an 'Input' in Refinery, you have to right-click on a compatible node and check the 'Is Input' option. Rename the node to see a legible input name in Refinery.
# note: Variables / Inputs
# Green indicates Variables that can be altered per project and must be set accordingly before running the script.
Z1 = DoubleSlider(18.7, range=15..20 step 0.1)  # graph input
# note: Working / Functions
# Orange indicates the working of the script. No changes should be made in these groups unless advised.
Z2 = DoubleSlider(26.7, range=25..30 step 0.1)  # graph input
Z3 = DoubleSlider(8.3, range=5..10 step 0.1)  # graph input
# note: Checking / Outputs
# Red indicates checking nodes to ensure the script has deployed correctly.
Z4 = DoubleSlider(36.5, range=35..40 step 0.1)  # graph input
Z5 = DoubleSlider(38, range=35..40 step 0.1)  # graph input
ml_sigma_value = DoubleSlider(77.9, range=0..100 step 0.1)  # graph input
ml_complexity_value = DoubleSlider(40.4, range=0..100 step 0.1)  # graph input

# group: Data: ML Training Data
number = DoubleInput(15)
number_2 = DoubleInput(0)
byCoordinates = Point.ByCoordinates(x=number, y=number_2, z=Z1)
list_create = List.Create(item0=number, item1=number_2)
number_3 = DoubleInput(50)
number_4 = DoubleInput(0)
list_create_2 = List.Create(item0=number_3, item1=number_4)
number_5 = DoubleInput(0)
number_6 = DoubleInput(30)
list_create_3 = List.Create(item0=number_5, item1=number_6)
number_7 = DoubleInput(30)
number_8 = DoubleInput(30)
list_create_4 = List.Create(item0=number_7, item1=number_8)
number_9 = DoubleInput(15)
number_10 = DoubleInput(15)
list_create_5 = List.Create(item0=number_9, item1=number_10)
list_create_6 = List.Create(item0=list_create, item1=list_create_2, item2=list_create_3, item3=list_create_4, item4=list_create_5)
byCoordinates_2 = Point.ByCoordinates(x=number_3, y=number_4, z=Z2)
byCoordinates_3 = Point.ByCoordinates(x=number_7, y=number_8, z=Z4)
byCoordinates_4 = Point.ByCoordinates(x=number_5, y=number_6, z=Z3)
byCoordinates_5 = Point.ByCoordinates(x=number_9, y=number_10, z=Z5)

# group: Geometry [Dynamo]: Generate ML Test Data (Base Points Grid)
number_11 = DoubleInput(10)
number_12 = DoubleInput(6)
sequence = Sequence(amount=number_11, step=number_12)
byCoordinates_6 = Point.ByCoordinates(x=sequence, y=sequence, lacing=CrossProduct)
number_13 = DoubleInput(3)
flatten = List.Flatten(list=byCoordinates_6, amt=number_13)
X = Point.X(point=flatten)
Y = Point.Y(point=flatten)
list_create_7 = List.Create(item0=X, item1=Y)
transpose = List.Transpose(lists=list_create_7)

# group: Machine Learning: Run ML model (Non-Linear Regression)
list_create_8 = List.Create(item0=Z1, item1=Z2, item2=Z3, item3=Z4, item4=Z5)
number_14 = DoubleInput(3)
nonLinearRegression = MachineLearning.Regression.NonLinearRegression(TestData=transpose, TrainingInputs=list_create_6, TrainingOutputs=list_create_8, sigma=ml_sigma_value, complex=ml_complexity_value, seed=number_14)
byCoordinates_7 = Point.ByCoordinates(x=X, y=Y, z=nonLinearRegression.Score)

# group: Geometry [Dynamo]: Generate Surface and create Quads
chop = List.Chop(list=byCoordinates_7, lengths=number_11)
byPoints = NurbsSurface.ByPoints(points=chop)
number_15 = DoubleInput(10)
lunchbox_quad_grid_by_face = Custom[LunchBox Quad Grid by Face](Surface=byPoints, U=number_15, V=number_15)  # Create a quadrangular XYZ grid on a face. The face surface must have an untrimmed UV parameter space.

# group: Data: Calculate panel planarity, average area and average distance from origin
closestPointTo = Geometry.ClosestPointTo(geometry=byCoordinates, other=byPoints)
distanceTo = Geometry.DistanceTo(geometry=byCoordinates, other=closestPointTo)
closestPointTo_2 = Geometry.ClosestPointTo(geometry=byCoordinates_2, other=byPoints)
distanceTo_2 = Geometry.DistanceTo(geometry=byCoordinates_2, other=closestPointTo_2)
closestPointTo_3 = Geometry.ClosestPointTo(geometry=byCoordinates_4, other=byPoints)
distanceTo_3 = Geometry.DistanceTo(geometry=byCoordinates_3, other=closestPointTo_3)
closestPointTo_4 = Geometry.ClosestPointTo(geometry=byCoordinates_3, other=byPoints)
distanceTo_4 = Geometry.DistanceTo(geometry=byCoordinates_3, other=closestPointTo_4)
closestPointTo_5 = Geometry.ClosestPointTo(geometry=byCoordinates_5, other=byPoints)
distanceTo_5 = Geometry.DistanceTo(geometry=byCoordinates_5, other=closestPointTo_5)
list_create_9 = List.Create(item0=distanceTo, item1=distanceTo_2, item2=distanceTo_3, item3=distanceTo_4, item4=distanceTo_5)
lunchbox_mass_addition = Custom[LunchBox Mass Addition](Numbers=list_create_9)  # Returns the total value of a list of numbers.
number_16 = DoubleInput(5)
div = lunchbox_mass_addition.Result / number_16
number_17 = DoubleInput(1)
flatten_2 = List.Flatten(list=lunchbox_quad_grid_by_face.Panel_Pts, amt=number_17)
transpose_2 = List.Transpose(lists=flatten_2)
number_18 = DoubleInput(3)
getItemAtIndex = List.GetItemAtIndex(list=transpose_2, index=number_18)
lunchbox_planarize_points = Custom[LunchBox Planarize Points](Points=lunchbox_quad_grid_by_face.Panel_Pts)  # Projects a list of a 4 or more points to a common plane.
number_19 = DoubleInput(1)
flatten_3 = List.Flatten(list=lunchbox_planarize_points, amt=number_19)
transpose_3 = List.Transpose(lists=flatten_3)
number_20 = DoubleInput(3)
getItemAtIndex_2 = List.GetItemAtIndex(list=transpose_3, index=number_20)
distanceTo_6 = Geometry.DistanceTo(geometry=getItemAtIndex, other=getItemAtIndex_2)
lunchbox_mass_addition_2 = Custom[LunchBox Mass Addition](Numbers=distanceTo_6)
count = List.Count(list=distanceTo_6)
div_2 = lunchbox_mass_addition_2.Result / count
number_21 = DoubleInput(2)
flatten_4 = List.Flatten(list=lunchbox_quad_grid_by_face.Panel_Faces, amt=number_21)
area = Surface.Area(surface=flatten_4)
lunchbox_mass_addition_3 = Custom[LunchBox Mass Addition](Numbers=area)
count_2 = List.Count(list=area)
div_3 = lunchbox_mass_addition_3.Result / count_2

# group: Outputs
average_distance_from_original = Watch(div)  # "Average Distance from Original Points"; graph output
# note: NOTE:
# In order to see an 'Output' in Refinery, you have to right-click on a compatible node and check the 'Is
# Output' option. Rename the node to see a legible output name in Refinery.
average_planarity = Watch(div_2)  # graph output
average_panel_area = Watch(div_3)  # graph output

# group: Visualization: Colourizes Dynamo geometry in the Background Preview window
code_block = CodeBlock(srfs=lunchbox_quad_grid_by_face.Panel_Faces) { DSCore.List.Flatten(srfs, -1); }
color_palette = ColorPalette({R: 5, G: 195, B: 222, A: 255})
byGeometryColor = Modifiers.GeometryColor.ByGeometryColor(geometry=code_block, color=color_palette)
list_create_10 = List.Create(item0=byCoordinates, item1=byCoordinates_2, item2=byCoordinates_4, item3=byCoordinates_3, item4=byCoordinates_5, item5=lunchbox_quad_grid_by_face.Panel_Polys)
flatten_5 = List.Flatten(list=list_create_10)
color_palette_2 = ColorPalette({R: 255, G: 138, B: 61, A: 255})
byGeometryColor_2 = Modifiers.GeometryColor.ByGeometryColor(geometry=flatten_5, color=color_palette_2)
