# Dynamo graph 18-SchoolOfFish_2D.dyn (Dynamo 2.0.2.6660)

# group: SCHOOL OF FISH: 2D Refinery Graph Example
# note: DYNAMO PROJECT
# 18-SchoolOfFish_2D.dyn
# note: ASSOCIATED FILE(S)
# N/A
# note: AUTHOR(S) / CREATION DATE
# Refinery Team and The Proving Ground / Dec 2018
# note: DESCRIPTION
# Adjust ML classification deviations by adjusting the importance values. The 'fish' are pointed polygons with values for XY location, XY direction, “swimming” depth, and area fed to the ML Gaussian Mix node. Domains of values are remapped before passing into the ML node; those domain ranges are adjusted by the importance value sliders. Average deviations are analyzed after classification and either minimized or maximized to see a range of input values for output values.
# This example is more abstract for those who are interested in machine learning optimization problems. This kind of problem is useful for pattern-finding and predictive pattern behavior through data clustering.
# note: DYNAMO VERSION
# 2.0.2
# note: ADDITIONAL COMMENTS
# N/A
# note: REQUIRED DYNAMO PACKAGES
# Lunchbox for Dynamo - v2018.7.6
# Note:
# The Lunchbox installation instructions are now the txt file in the Extra folder. To install Lunchbox you have to use an external installer in liue of the Package Manager.

# group: Create Fish
number_of_fish = IntegerSlider(500, range=200..2000 step 1)
code_block = CodeBlock(x=number_of_fish) { 0; 15; x*2; }
location_seed = DoubleSlider(500, range=0..1000 step 0.1)
randomNumbers = Lists.Sequence.RandomNumbers(Min=code_block.out0, Max=code_block.out1, Number=code_block.out2, Seed=location_seed)
code_block_2 = CodeBlock { [0,1]; 2; }
sublists = List.Sublists(list=randomNumbers, ranges=code_block_2.out0, offset=code_block_2.out1)
numbersToPoint = Geometry.Points.NumbersToPoint(Numbers=sublists)
ZAxis = Vector.ZAxis()
code_block_3 = CodeBlock(x=number_of_fish) { 0; 3; x; }
depth_seed = DoubleSlider(472.8, range=0..1000 step 0.1)
randomNumbers_2 = Lists.Sequence.RandomNumbers(Min=code_block_3.out0, Max=code_block_3.out1, Number=code_block_3.x, Seed=depth_seed)
translate = Geometry.Translate(geometry=numbersToPoint, direction=ZAxis, distance=randomNumbers_2)
flatten = List.Flatten(list=translate)
code_block_4 = CodeBlock(x=number_of_fish) { -1; 1; x*2; }
direction_seed = DoubleSlider(136, range=0..1000 step 0.1)
randomNumbers_3 = Lists.Sequence.RandomNumbers(Min=code_block_4.out0, Max=code_block_4.out1, Number=code_block_4.out2, Seed=direction_seed)
sublists_2 = List.Sublists(list=randomNumbers_3, ranges=code_block_2.out0, offset=code_block_2.out1)
transpose = List.Transpose(lists=sublists_2)
firstItem = List.FirstItem(list=transpose)
code_block_5 = CodeBlock { 1; }
getItemAtIndex = List.GetItemAtIndex(list=transpose, index=code_block_5)
code_block_6 = CodeBlock { 0; }
byCoordinates = Vector.ByCoordinates(x=firstItem, y=getItemAtIndex, z=code_block_6)
code_block_7 = CodeBlock(x=number_of_fish) { 0.1; 1; x; }
length_seed = DoubleSlider(315.3, range=0..1000 step 0.1)
randomNumbers_4 = Lists.Sequence.RandomNumbers(Min=code_block_7.out0, Max=code_block_7.out1, Number=code_block_7.x, Seed=length_seed)
translate_2 = Geometry.Translate(geometry=numbersToPoint, direction=byCoordinates, distance=randomNumbers_4)
translate_3 = Geometry.Translate(geometry=translate_2, direction=ZAxis, distance=randomNumbers_2)
ZAxis_2 = Vector.ZAxis()
code_block_8 = CodeBlock { -20; 20; }
rotate = Vector.Rotate(vector=byCoordinates, axis=ZAxis_2, degrees=code_block_8.out0)
reverse = Vector.Reverse(vector=rotate)
code_block_9 = CodeBlock(d=randomNumbers_4) { d*1.3; }
translate_4 = Geometry.Translate(geometry=translate_3, direction=reverse, distance=code_block_9)
flatten_2 = List.Flatten(list=translate_4)
flatten_3 = List.Flatten(list=translate_3)
rotate_2 = Vector.Rotate(vector=byCoordinates, axis=ZAxis_2, degrees=code_block_8.out1)
reverse_2 = Vector.Reverse(vector=rotate_2)
translate_5 = Geometry.Translate(geometry=translate_3, direction=reverse_2, distance=code_block_9)
flatten_4 = List.Flatten(list=translate_5)
python_script = Python(IN[0]=flatten, IN[1]=flatten_2, IN[2]=flatten_3, IN[3]=flatten_4)
# ---------- python_script.python (23 lines) ----------
# Enable Python support and load DesignScript library
import clr
clr.AddReference('ProtoGeometry')
from Autodesk.DesignScript.Geometry import *

# The inputs to this node will be stored as a list in the IN variables.
dataEnteringNode = IN

polygons = []

for i in range(IN[0].Count):
	pts = []
	pts.Add(IN[0][i])
	pts.Add(IN[1][i])
	pts.Add(IN[2][i])
	pts.Add(IN[3][i])
	polygons.Add(Polygon.ByPoints(pts))
	
	
# Place your code below this line

# Assign your output to the OUT variable.
OUT = polygons
# ----------------------------------------
byPatch = Surface.ByPatch(closedCurve=python_script)
area = Surface.Area(surface=byPatch)

# group: Inputs
# note: Variables / Inputs
# Red indicates Variables that can be altered per project and must be set accordingly before running the script.
# note: NOTE:
# In order to see an 'Input' in Refinery, you have to right-click on a compatible node and check the 'Is Input' option. Rename the node to see a legible input name in Refinery.
location_importance = DoubleSlider(5.155813592, range=1..10 step 0.1)  # graph input
# note: Working / Functions
# Green indicates the working of the script. No changes should be made in these groups unless advised.
direction_importance = DoubleSlider(4.367918455, range=1..10 step 0.1)  # graph input
area_importance = DoubleSlider(2.524859386, range=1..10 step 0.1)  # graph input
# note: Checking / Outputs
# Orange indicates checking nodes to ensure the script has deployed correctly.
depth_importance = DoubleSlider(3.267792719, range=1..10 step 0.1)  # graph input

# group: Data Reg Location
deconstructPoint = Geometry.Points.DeconstructPoint(point=numbersToPoint)
flatten_5 = List.Flatten(list=deconstructPoint.X)
code_block_10 = CodeBlock { 0; }
mapTo = Math.MapTo(rangeMin=code_block.out0, rangeMax=code_block.out1, inputValue=flatten_5, targetRangeMin=code_block_10, targetRangeMax=location_importance)
flatten_6 = List.Flatten(list=deconstructPoint.Y)
mapTo_2 = Math.MapTo(rangeMin=code_block.out0, rangeMax=code_block.out1, inputValue=flatten_6, targetRangeMin=code_block_10, targetRangeMax=location_importance)

# group: Data Reg: Direction
flatten_7 = List.Flatten(list=firstItem)
code_block_11 = CodeBlock { 0; }
mapTo_3 = Math.MapTo(rangeMin=code_block_4.out0, rangeMax=code_block_4.out1, inputValue=flatten_7, targetRangeMin=code_block_11, targetRangeMax=direction_importance)
flatten_8 = List.Flatten(list=getItemAtIndex)
mapTo_4 = Math.MapTo(rangeMin=code_block_4.out0, rangeMax=code_block_4.out1, inputValue=flatten_8, targetRangeMin=code_block_11, targetRangeMax=direction_importance)

# group: Data Reg: Area
sort = List.Sort(list=area)
firstItem_2 = List.FirstItem(list=sort)
lastItem = List.LastItem(list=sort)
code_block_12 = CodeBlock { 0; }
mapTo_5 = Math.MapTo(rangeMin=firstItem_2, rangeMax=lastItem, inputValue=area, targetRangeMin=code_block_12, targetRangeMax=area_importance)

# group: Data Reg: Depth
sort_2 = List.Sort(list=randomNumbers_2)
firstItem_3 = List.FirstItem(list=sort_2)
lastItem_2 = List.LastItem(list=sort_2)
code_block_13 = CodeBlock { 0; }
mapTo_6 = Math.MapTo(rangeMin=firstItem_3, rangeMax=lastItem_2, inputValue=randomNumbers_2, targetRangeMin=code_block_13, targetRangeMax=depth_importance)

# group: The target number of clusters
number_of_species = IntegerSlider(7, range=3..12 step 1)

# group: Machine Learning: ML Classification
list_create = List.Create(item0=mapTo, item1=mapTo_2, item2=mapTo_3, item3=mapTo_4, item4=mapTo_5, item5=mapTo_6)
transpose_2 = List.Transpose(lists=list_create)
code_block_14 = CodeBlock { 5; }
gaussianMixture = MachineLearning.Classification.GaussianMixture(InputList=transpose_2, Components=number_of_species, seed=code_block_14)

# group: Classification Viz
code_block_15 = CodeBlock { [243,236,210,103,39,1,18,220,247,243]; [57,27,0,0,72,192,178,237,159,57]; [0,60,118,120,161,229,90,32,20,0]; }
byARGB = Color.ByARGB(r=code_block_15.out0, g=code_block_15.out1, b=code_block_15.out2)
code_block_16 = CodeBlock { 0; 1; }
remapRange = Math.RemapRange(numbers=gaussianMixture.Result, newMin=code_block_16.out0, newMax=code_block_16.out1)
uniqueItems = List.UniqueItems(list=remapRange)
sort_3 = List.Sort(list=uniqueItems)
color_range = ColorRange(colors=byARGB, indices=sort_3, value=remapRange)
byGeometryColor = Modifiers.GeometryColor.ByGeometryColor(geometry=byPatch, color=color_range)

# group: Data: Average Distance by Category
flatten_9 = List.Flatten(list=translate)
groupByKey = List.GroupByKey(list=flatten_9, keys=gaussianMixture.Result)
python_script_2 = Python(IN[0]=groupByKey.groups)
# ---------- python_script_2.python (28 lines) ----------
# Enable Python support and load DesignScript library
import clr
clr.AddReference('ProtoGeometry')
from Autodesk.DesignScript.Geometry import *

# The inputs to this node will be stored as a list in the IN variables.
dataEnteringNode = IN

# Place your code below this line

averages = []

for pts in IN[0]:
	X = 0
	Y = 0
	Z = 0
	for pt in pts:
		X += pt.X
		Y += pt.Y
		Z += pt.Z
	X = X/pts.Count
	Y = Y/pts.Count
	Z = Z/pts.Count
	averages.Add(Point.ByCoordinates(X,Y,Z))


# Assign your output to the OUT variable.
OUT = averages
# ----------------------------------------
distanceTo = Geometry.DistanceTo(geometry=python_script_2, other=groupByKey.groups)
average = Math.Average(numbers=distanceTo)
average_2 = Math.Average(numbers=average)

# group: Data: Average Area by Category
groupByKey_2 = List.GroupByKey(list=area, keys=gaussianMixture.Result)
average_3 = Math.Average(numbers=groupByKey_2.groups)
code_block_17 = CodeBlock(Avg=average_3, Val=groupByKey_2.groups) { Math.Abs(Avg-Val); }
average_4 = Math.Average(numbers=code_block_17)
average_5 = Math.Average(numbers=average_4)

# group: Data: Average Deviation in Direction by Category
flatten_10 = List.Flatten(list=byCoordinates)
groupByKey_3 = List.GroupByKey(list=flatten_10, keys=gaussianMixture.Result)
python_script_3 = Python(IN[0]=groupByKey_3.groups)
# ---------- python_script_3.python (28 lines) ----------
# Enable Python support and load DesignScript library
import clr
clr.AddReference('ProtoGeometry')
from Autodesk.DesignScript.Geometry import *

# The inputs to this node will be stored as a list in the IN variables.
dataEnteringNode = IN

# Place your code below this line

averages = []

for vecs in IN[0]:
	X = 0
	Y = 0
	Z = 0
	for vec in vecs:
		X += vec.X
		Y += vec.Y
		Z += vec.Z
	X = X/vecs.Count
	Y = Y/vecs.Count
	Z = Z/vecs.Count
	averages.Add(Vector.ByCoordinates(X,Y,Z))


# Assign your output to the OUT variable.
OUT = averages
# ----------------------------------------
angleWithVector = Vector.AngleWithVector(vector=python_script_3, otherVector=groupByKey_3.groups)
degreesToRadians = Math.DegreesToRadians(degrees=angleWithVector)
average_6 = Math.Average(numbers=degreesToRadians)
average_7 = Math.Average(numbers=average_6)

# group: Data: Average Depth by Category
groupByKey_4 = List.GroupByKey(list=randomNumbers_2, keys=gaussianMixture.Result)
average_8 = Math.Average(numbers=groupByKey_4.groups)
code_block_18 = CodeBlock(Avg=average_8, Val=groupByKey_4.groups) { Math.Abs(Avg-Val); }
average_9 = Math.Average(numbers=code_block_18)
average_10 = Math.Average(numbers=average_9)

# group: Outputs
# note: NOTE:
# In order to see an 'Output' in Refinery, you have to right-click on a compatible node and check the 'Is
# Output' option. Rename the node to see a legible output name in Refinery.
distance_deviation = Watch(average_2)  # graph output
area_deviation = Watch(average_5)  # graph output
direction_deviation = Watch(average_7)  # graph output
depth_deviation = Watch(average_10)  # graph output
