# Dynamo graph 19-SchoolOfFish_3D.dyn (Dynamo 2.0.2.6660)

# group: SCHOOL OF FISH: 3D Refinery Graph Example
# note: DYNAMO PROJECT
# 19-SchoolOfFish_3D.dyn
# note: ASSOCIATED FILE(S)
# N/A
# note: AUTHOR(S) / CREATION DATE
# Refinery Team and The Proving Ground / Dec 2018
# note: DYNAMO VERSION
# 2.0.2
# note: ADDITIONAL COMMENTS
# N/A
# note: REQUIRED DYNAMO PACKAGES
# Clockwork for Dynamo 2.X - v2.1.0
# Lunchbox for Dynamo - v2018.7.6
# Note:
# The Lunchbox installation instructions are now the txt file in the Extra folder. To install Lunchbox you have to use an external installer in liue of the Package Manager.
# note: DESCRIPTION
# Adjust ML classification deviations by adjusting the importance values. The 'fish' are pointed polygons with values for XY location, XY direction, “swimming” depth, and area fed to the ML Gaussian Mix node. Domains of values are remapped before passing into the ML node; those domain ranges are adjusted by the importance value sliders. Average deviations are analyzed after classification and either minimized or maximized to see a range of input values for output values.
# This example is more abstract for those who are interested in machine learning optimization problems. This kind of problem is useful for pattern-finding and predictive pattern behavior through data clustering.

# group: Make Fish
number_of_fish = IntegerSlider(500, range=200..2000 step 1)
code_block = CodeBlock(x=number_of_fish) { 0; 15; x*3; }
location_seed = DoubleSlider(1000, range=0..1000 step 0.1)
randomNumbers = Lists.Sequence.RandomNumbers(Min=code_block.out0, Max=code_block.out1, Number=code_block.out2, Seed=location_seed)
code_block_2 = CodeBlock { [0,1,2]; 3; }
sublists = List.Sublists(list=randomNumbers, ranges=code_block_2.out0, offset=code_block_2.out1)
numbersToPoint = Geometry.Points.NumbersToPoint(Numbers=sublists)
code_block_3 = CodeBlock(x=number_of_fish) { -1; 1; x*3; }
direction_seed = DoubleSlider(136, range=0..1000 step 0.1)
randomNumbers_2 = Lists.Sequence.RandomNumbers(Min=code_block_3.out0, Max=code_block_3.out1, Number=code_block_3.out2, Seed=direction_seed)
sublists_2 = List.Sublists(list=randomNumbers_2, ranges=code_block_2.out0, offset=code_block_2.out1)
transpose = List.Transpose(lists=sublists_2)
firstItem = List.FirstItem(list=transpose)
code_block_4 = CodeBlock { 1; }
getItemAtIndex = List.GetItemAtIndex(list=transpose, index=code_block_4)
lastItem = List.LastItem(list=transpose)
byCoordinates = Vector.ByCoordinates(x=firstItem, y=getItemAtIndex, z=lastItem)
code_block_5 = CodeBlock(x=number_of_fish) { 0; 1; x; }
length_seed = DoubleSlider(315.3, range=0..1000 step 0.1)
randomNumbers_3 = Lists.Sequence.RandomNumbers(Min=code_block_5.out0, Max=code_block_5.out1, Number=code_block_5.x, Seed=length_seed)
translate = Geometry.Translate(geometry=numbersToPoint, direction=byCoordinates, distance=randomNumbers_3)
code_block_6 = CodeBlock(x=number_of_fish) { 0.025; 0.5; x; }
radius_seed = DoubleSlider(425.6, range=0..1000 step 0.1)
randomNumbers_4 = Lists.Sequence.RandomNumbers(Min=code_block_6.out0, Max=code_block_6.out1, Number=code_block_6.x, Seed=radius_seed)
byPointsRadius = Cone.ByPointsRadius(startPoint=numbersToPoint, endPoint=translate, startRadius=randomNumbers_4)

# group: Inputs: Changeable variables
# note: Variables / Inputs
# Red indicates Variables that can be altered per project and must be set accordingly before running the script.
# note: NOTE:
# In order to see an 'Input' in Refinery, you have to right-click on a compatible node and check the 'Is Input' option. Rename the node to see a legible input name in Refinery.
location_importance = DoubleSlider(8.567201237, range=1..10 step 0.1)  # graph input
# note: Working / Functions
# Green indicates the working of the script. No changes should be made in these groups unless advised.
direction_importance = DoubleSlider(8.09093989, range=1..10 step 0.1)  # graph input
length_importance = DoubleSlider(7.519950806, range=1..10 step 0.1)  # graph input
# note: Checking / Outputs
# Orange indicates checking nodes to ensure the script has deployed correctly.
radius_importance = DoubleSlider(2.912332659, range=1..10 step 0.1)  # graph input

# group: Data Reg: Location
deconstructPoint = Geometry.Points.DeconstructPoint(point=numbersToPoint)
flatten = List.Flatten(list=deconstructPoint.X)
code_block_7 = CodeBlock { 0; }
mapTo = Math.MapTo(rangeMin=code_block.out0, rangeMax=code_block.out1, inputValue=flatten, targetRangeMin=code_block_7, targetRangeMax=location_importance)
flatten_2 = List.Flatten(list=deconstructPoint.Y)
mapTo_2 = Math.MapTo(rangeMin=code_block.out0, rangeMax=code_block.out1, inputValue=flatten_2, targetRangeMin=code_block_7, targetRangeMax=location_importance)
flatten_3 = List.Flatten(list=deconstructPoint.Z)
mapTo_3 = Math.MapTo(rangeMin=code_block.out0, rangeMax=code_block.out1, inputValue=flatten_3, targetRangeMin=code_block_7, targetRangeMax=location_importance)

# group: Data Reg: Direction
flatten_4 = List.Flatten(list=firstItem)
code_block_8 = CodeBlock { 0; }
mapTo_4 = Math.MapTo(rangeMin=code_block_3.out0, rangeMax=code_block_3.out1, inputValue=flatten_4, targetRangeMin=code_block_8, targetRangeMax=direction_importance)
flatten_5 = List.Flatten(list=getItemAtIndex)
mapTo_5 = Math.MapTo(rangeMin=code_block_3.out0, rangeMax=code_block_3.out1, inputValue=flatten_5, targetRangeMin=code_block_8, targetRangeMax=direction_importance)
flatten_6 = List.Flatten(list=lastItem)
mapTo_6 = Math.MapTo(rangeMin=code_block_3.out0, rangeMax=code_block_3.out1, inputValue=flatten_6, targetRangeMin=code_block_8, targetRangeMax=direction_importance)

# group: Data Reg: Length
code_block_9 = CodeBlock { 0; }
mapTo_7 = Math.MapTo(rangeMin=code_block_5.out0, rangeMax=code_block_5.out1, inputValue=randomNumbers_3, targetRangeMin=code_block_9, targetRangeMax=length_importance)

# group: Data Reg: Radius
code_block_10 = CodeBlock { 0; }
mapTo_8 = Math.MapTo(rangeMin=code_block_6.out0, rangeMax=code_block_6.out1, inputValue=randomNumbers_4, targetRangeMin=code_block_10, targetRangeMax=radius_importance)

# group: Machine Learning: ML Classification
list_create = List.Create(item0=mapTo, item1=mapTo_2, item2=mapTo_3, item3=mapTo_4, item4=mapTo_5, item5=mapTo_6, item6=mapTo_7, item7=mapTo_8)
transpose_2 = List.Transpose(lists=list_create)
code_block_11 = CodeBlock { 8; 5; }
gaussianMixture = MachineLearning.Classification.GaussianMixture(InputList=transpose_2, Components=code_block_11.out0, seed=code_block_11.out1)

# group: Classification Viz
code_block_12 = CodeBlock { [243,236,210,103,39,1,18,220,247,243]; [57,27,0,0,72,192,178,237,159,57]; [0,60,118,120,161,229,90,32,20,0]; }
byARGB = Color.ByARGB(r=code_block_12.out0, g=code_block_12.out1, b=code_block_12.out2)
code_block_13 = CodeBlock { 0; 1; }
remapRange = Math.RemapRange(numbers=gaussianMixture.Result, newMin=code_block_13.out0, newMax=code_block_13.out1)
uniqueItems = List.UniqueItems(list=remapRange)
sort = List.Sort(list=uniqueItems)
color_range = ColorRange(colors=byARGB, indices=sort, value=remapRange)
byGeometryColor = Modifiers.GeometryColor.ByGeometryColor(geometry=byPointsRadius, color=color_range)

# group: Data: Average Distance by Category
flatten_7 = List.Flatten(list=numbersToPoint)
groupByKey = List.GroupByKey(list=flatten_7, keys=gaussianMixture.Result)
average = Custom[Point.Average](points=groupByKey.groups)  # Determines the average of a list of points
distanceTo = Geometry.DistanceTo(geometry=average, other=groupByKey.groups)
average_2 = Math.Average(numbers=distanceTo)
average_3 = Math.Average(numbers=average_2)

# group: Data: Average Volume by Category
volume = Solid.Volume(solid=byPointsRadius)
flatten_8 = List.Flatten(list=volume)
groupByKey_2 = List.GroupByKey(list=flatten_8, keys=gaussianMixture.Result)
average_4 = Math.Average(numbers=groupByKey_2.groups)
average_5 = Math.Average(numbers=average_4)

# group: Data: Average Deviation in Direction by Category
flatten_9 = List.Flatten(list=byCoordinates)
groupByKey_3 = List.GroupByKey(list=flatten_9, keys=gaussianMixture.Result)
average_6 = Custom[Vector.Average](vectors=groupByKey_3.groups)  # Determines the average vector of a list of vectors
angleWithVector = Vector.AngleWithVector(vector=average_6, otherVector=groupByKey_3.groups)
degreesToRadians = Math.DegreesToRadians(degrees=angleWithVector)
average_7 = Math.Average(numbers=degreesToRadians)
average_8 = Math.Average(numbers=average_7)

# group: Outputs
distance_deviation = Watch(average_3)  # graph output
# note: NOTE:
# In order to see an 'Output' in Refinery, you have to right-click on a compatible node and check the 'Is
# Output' option. Rename the node to see a legible output name in Refinery.
volume_deviation = Watch(average_5)  # graph output
direction_deviation = Watch(average_8)  # graph output
